# Grasshopper definition 1D Element-Test.gh (Grasshopper 1.0.7)
# plug-ins: BH.UI.Grasshopper

sectiondatabase = SectionDatabase(
    {"None": 0, "AISC14": 1, "AISC14M": 2, "AISC15": 3, "AISC15M": 4, "ArcelorMittal_British": 5, "ArcelorMittal_BritishHISTAR": 6, "ArcelorMittal_Europe": 7, "ArcelorMittal_EuropeHISTAR": 8, "ArcelorMittal_Japan": 9, "ArcelorMittal_Russia": 10, "ArcelorMittal_US_ASTM_A913": 11, "ArcelorMittal_US_ASTM_A913M": 12, "ArcelorMittal_US_ASTM_A992": 13, "ArcelorMittal_US_ASTM_A992M": 14, "Australia_NewZealand": 15, "BSShapes2006": 16, "ChineseGB08": 17, "CISC9": 18, "CISC10": 19, "CoreBraceBRB_2016": 20, "Euro": 21, "Indian": 22, "JIS_G_3192_2014": 23, "Nordic": 24, "Russian": 25, "SJIJoists": 26, "StarSeismicBRB": 27}, selected="AISC14",
    Component="BH.oM.Adapters.ETABS.SectionDatabase",
    Selection=1)
steel = Steel(
    {"A36": 0, "A500GrB42": 1, "A500GrB46": 2, "A500GrC46": 3, "A500GrC50": 4, "A53GrB": 5, "A572Gr50": 6, "A709Gr36": 7, "A709Gr50": 8, "A709Gr50S": 9, "A709Gr50W": 10, "A709GrHPS100W": 11, "A709GrHPS50W": 12, "A709GrHPS70W": 13, "A913Gr50": 14, "A992Fy50": 15}, selected="A992Fy50",
    Component="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",
    Selection=15)
databasesettings = DatabaseSettings(SectionDatabase=sectiondatabase, Component="BH.oM.Adapters.ETABS.DatabaseSettings")
steelcircularsection = SteelCircularSection(Diameter=Slider(2, range=0..10), Material=steel, Component="{ .SteelCircularSection")

toggle = BooleanToggle(False)
etabssettings = EtabsSettings(
    ReplaceLoads=toggle,
    DatabaseSettings=databasesettings,
    EtabsVersion="{ \"_t\" : \"System.Enum\", \"TypeName\" : { \"_t\" : \"System.Type\", \"Name\" : \"BH.oM.Adapters.ETABS.EtabsVersion\", \"_bhomVersion\" : \"9.2\" }, \"Value\" : \"v18\", \"_bhomVersion\" : \"9.2\" }",
    Component="BH.oM.Adapters.ETABS.EtabsSettings")
etabs2016adapter = ETABS2016Adapter(
    FilePath="C:\Users\Tufail Mabood\Desktop\ETABs\1DBar.EDB",
    EtabsSetting=etabssettings,
    Active=toggle,
    Component="{ ..ctor")

point = Point(X="45", Y=0, Z=0, Component="BH.oM.Geometry.Point")
vector = Vector(P=point, Component="{ .Vector")
number_slider = Slider(10, range=0..10)
loadnature = LoadNature(
    {"Dead": 0, "SuperDead": 1, "Live": 2, "Wind": 3, "Seismic": 4, "Temperature": 5, "Snow": 6, "Accidental": 7, "Prestress": 8, "Notional": 9, "Other": 10}, selected="Dead",
    Component="BH.oM.Structure.Loads.LoadNature",
    Selection=0)
barreleasefixfix = BarReleaseFixFix(Name="FixFix", Component="{ .BarReleaseFixFix")
barfeatype = BarFEAType(
    {"Flexural": 0, "Axial": 1, "CompressionOnly": 2, "TensionOnly": 3}, selected="Flexural",
    Component="BH.oM.Structure.Elements.BarFEAType",
    Selection=0)
pt = ConstructPoint(XCoordinate=0, YCoordinate=0, ZCoordinate=0)
pt_2 = ConstructPoint(XCoordinate=0, YCoordinate=0, ZCoordinate=number_slider)
loadcase = Loadcase(Name="Dead", Nature=loadnature, Number="1", Component="BH.oM.Structure.Loads.Loadcase")
ln = Line(StartPoint=pt, EndPoint=pt_2)
pushtype = PushType(
    {"FullPush": 0, "CreateOnly": 1, "CreateNonExisting": 2, "UpdateOnly": 3, "UpdateOrCreateOnly": 4, "DeleteThenCreate": 5, "AdapterDefault": 6}, selected="CreateNonExisting",
    Component="BH.oM.Adapter.PushType",
    Selection=2)
bar = Bar(
    Line=ln,
    SectionProperty=steelcircularsection,
    OrientationAngle=0,
    Release=barreleasefixfix,
    FeaType=barfeatype,
    Component="{ .Bar")
barpointload = BarPointLoad(
    Loadcase=loadcase,
    DistFromA=number_slider,
    Objects=bar,
    Force=vector,
    Axis="{ \"_t\" : \"System.Enum\", \"TypeName\" : { \"_t\" : \"System.Type\", \"Name\" : \"BH.oM.Structure.Loads.LoadAxis\", \"_bhomVersion\" : \"9.2\" }, \"Value\" : \"Global\", \"_bhomVersion\" : \"9.2\" }",
    Component="{ .BarPointLoad")
push = Push(Adapter=etabs2016adapter, Objects=flatten([bar, barpointload]), PushType=pushtype, Active=toggle, Component="{ .Push")  # -> Objects, Success
save = Save(Component="BH.oM.Adapter.Commands.Save")
execute = Execute(Adapter=etabs2016adapter, Command=save, Active=toggle, Component="{ .Execute")  # -> Output, Success
