# Grasshopper definition 2D Frame-Test-Pushover Analysis-Bar Outputs.gh (Grasshopper 1.0.7)
# plug-ins: BH.UI.Grasshopper

number_of_stories_g_4 = Slider(5, range=1..10)
height_m = Slider(2, range=2..10)
width_m = Slider(2, range=2..10)
push_geometry_to_etab = BooleanToggle(False)
run_analysis = BooleanToggle(False)
update_base_shear = BooleanToggle(False)

# ----
# Frame
dom = ConstructDomain(DomainStart=expr("-x/2", width_m), DomainEnd=expr("x/2", width_m))
pt = ConstructPoint(XCoordinate=expr("-x", dom), YCoordinate=0, ZCoordinate=0)
pt_2 = ConstructPoint(XCoordinate=dom, YCoordinate=0, ZCoordinate=0)
Z = UnitZ(Factor=height_m)
arrlinear = LinearArray(Geometry=[pt_2, pt], Direction=Z, Count=expr("x+1", number_of_stories_g_4))  # -> Geometry, Transform
cull_i = CullIndex(List=arrlinear.Geometry, Indices=0, Wrap=True)
flip = FlipMatrix(Data=cull_i)
dispatch = Dispatch(List=flip, DispatchPattern=[True, False])  # -> ListA, ListB
columns = PolyLine(Vertices=arrlinear.Geometry, Closed=False)
beams = Line(StartPoint=dispatch.ListA, EndPoint=dispatch.ListB)

# ----
# Adapter
sectiondatabase = SectionDatabase(
    {"None": 0, "AISC14": 1, "AISC14M": 2, "AISC15": 3, "AISC15M": 4, "ArcelorMittal_British": 5, "ArcelorMittal_BritishHISTAR": 6, "ArcelorMittal_Europe": 7, "ArcelorMittal_EuropeHISTAR": 8, "ArcelorMittal_Japan": 9, "ArcelorMittal_Russia": 10, "ArcelorMittal_US_ASTM_A913": 11, "ArcelorMittal_US_ASTM_A913M": 12, "ArcelorMittal_US_ASTM_A992": 13, "ArcelorMittal_US_ASTM_A992M": 14, "Australia_NewZealand": 15, "BSShapes2006": 16, "ChineseGB08": 17, "CISC9": 18, "CISC10": 19, "CoreBraceBRB_2016": 20, "Euro": 21, "Indian": 22, "JIS_G_3192_2014": 23, "Nordic": 24, "Russian": 25, "SJIJoists": 26, "StarSeismicBRB": 27}, selected="None",
    Component="BH.oM.Adapters.ETABS.SectionDatabase",
    Selection=0)
panel = Panel("C:\Users\Tufail Mabood\Desktop\ETABs\2D Frame-Test-Pushover Loading.EDB")
databasesettings = DatabaseSettings(SectionDatabase=sectiondatabase, Component="BH.oM.Adapters.ETABS.DatabaseSettings")
etabssettings = EtabsSettings(
    ReplaceLoads=False,
    DatabaseSettings=databasesettings,
    EtabsVersion="{ \"_t\" : \"System.Enum\", \"TypeName\" : { \"_t\" : \"System.Type\", \"Name\" : \"BH.oM.Adapters.ETABS.EtabsVersion\", \"_bhomVersion\" : \"9.2\" }, \"Value\" : \"v18\", \"_bhomVersion\" : \"9.2\" }",
    Component="BH.oM.Adapters.ETABS.EtabsSettings")
etabs2016adapter = ETABS2016Adapter(FilePath=panel, EtabsSetting=etabssettings, Active=push_geometry_to_etab, Component="{ ..ctor")
adapter = BHoMAdapter(
    etabs2016adapter,
    ObjectType="{ \"_t\" : \"System.Type\", \"Name\" : \"System.Object, mscorlib, Version=4.0.0.0, Culture=neutral, PublicKeyToken=b77a5c561934e089\", \"_bhomVersion\" : \"9.2\" }",
    m_ForcePreview=False,
    m_MaxItemsPreview=10000)

steel = Steel(
    {"S235": 0, "S275": 1, "S355": 2, "S450": 3}, selected="S355",
    Component="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",
    Selection=2)
tubeprofile = TubeProfile(Diameter=Slider(0.2, range=0.1..0.3), Thickness=Slider(0.01, range=0..0.01), Component="{ .TubeProfile")
tubeprofile_2 = TubeProfile(Diameter=Slider(0.2, range=0.1..0.3), Thickness=Slider(0.01, range=0..0.01), Component="{ .TubeProfile")
genericsectionfromprofile = GenericSectionFromProfile(Profile=tubeprofile_2, Material=steel, Component="{ .GenericSectionFromProfile")
genericsectionfromprofile_2 = GenericSectionFromProfile(Profile=tubeprofile, Material=steel, Component="{ .GenericSectionFromProfile")
udl_on_left_column = Slider(100, range=0..100)
loadnature = LoadNature(
    {"Dead": 0, "SuperDead": 1, "Live": 2, "Wind": 3, "Seismic": 4, "Temperature": 5, "Snow": 6, "Accidental": 7, "Prestress": 8, "Notional": 9, "Other": 10}, selected="Dead",
    Component="BH.oM.Structure.Loads.LoadNature",
    Selection=0)
barfeatype = BarFEAType(
    {"Flexural": 0, "Axial": 1, "CompressionOnly": 2, "TensionOnly": 3}, selected="Flexural",
    Component="BH.oM.Structure.Elements.BarFEAType",
    Selection=0)
barfeatype_2 = BarFEAType(
    {"Flexural": 0, "Axial": 1, "CompressionOnly": 2, "TensionOnly": 3}, selected="Flexural",
    Component="BH.oM.Structure.Elements.BarFEAType",
    Selection=0)
loadcase = Loadcase(Name="Dead", Nature=loadnature, Number="1", Component="BH.oM.Structure.Loads.Loadcase")
line = Line(columns)
line_2 = Line(beams)
vector = Vector(X=udl_on_left_column, Component="{ .Vector")
bar = Bar(
    Line=flatten(line),
    SectionProperty=genericsectionfromprofile,
    OrientationAngle=0,
    FeaType=barfeatype,
    Name="Column",
    Component="{ .Bar")
item = ListItem(List=bar, Index=1, Wrap=True)
bhomgroup = BHoMGroup(Elements=item, DownCast=True, Component="{ .BHoMGroup")
bar_2 = Bar(
    Line=flatten(line_2),
    SectionProperty=genericsectionfromprofile_2,
    OrientationAngle=0,
    FeaType=barfeatype_2,
    Name="Beam",
    Component="{ .Bar")
baruniformlydistributedload = BarUniformlyDistributedLoad(
    Force=vector,
    Moment="{ \"_t\" : \"BH.oM.Geometry.Vector\", \"X\" : 0.0, \"Y\" : 0.0, \"Z\" : 0.0, \"_bhomVersion\" : \"9.2\" }",
    Loadcase=loadcase,
    Objects=bhomgroup,
    Axis="{ \"_t\" : \"System.Enum\", \"TypeName\" : { \"_t\" : \"System.Type\", \"Name\" : \"BH.oM.Structure.Loads.LoadAxis\", \"_bhomVersion\" : \"9.2\" }, \"Value\" : \"Global\", \"_bhomVersion\" : \"9.2\" }",
    Projected=False,
    Component="BH.oM.Structure.Loads.BarUniformlyDistributedLoad")
merge = Merge(Data1=bar, Data2=bar_2, Data3=baruniformlydistributedload)
pushtype = PushType(
    {"FullPush": 0, "CreateOnly": 1, "CreateNonExisting": 2, "UpdateOnly": 3, "UpdateOrCreateOnly": 4, "DeleteThenCreate": 5, "AdapterDefault": 6}, selected="CreateNonExisting",
    Component="BH.oM.Adapter.PushType",
    Selection=2)
divisiontype = DivisionType(
    {"EvenlyDistributed": 0, "ExtremeValues": 1}, selected="EvenlyDistributed",
    Component="BH.oM.Structure.Requests.DivisionType",
    Selection=0)
barresulttype = BarResultType(
    {"BarForce": 0, "BarDeformation": 1, "BarStress": 2, "BarStrain": 3, "BarDisplacement": 4, "BarModeShape": 5}, selected="BarForce",
    Component="BH.oM.Structure.Requests.BarResultType",
    Selection=0)
adapter_2 = BHoMAdapter(
    adapter,
    ObjectType="{ \"_t\" : \"System.Type\", \"Name\" : \"System.Object, mscorlib, Version=4.0.0.0, Culture=neutral, PublicKeyToken=b77a5c561934e089\", \"_bhomVersion\" : \"9.2\" }",
    m_ForcePreview=False,
    m_MaxItemsPreview=10000)
push = Push(Adapter=adapter_2, Objects=flatten(merge), PushType=pushtype, Active=push_geometry_to_etab, Component="{ .Push")  # -> Objects, Success
barresultrequest = BarResultRequest(ResultType=barresulttype, DivisionType=divisiontype, Divisions=0, Component="BH.oM.Structure.Requests.BarResultRequest")
adapter_3 = BHoMAdapter(
    adapter,
    ObjectType="{ \"_t\" : \"System.Type\", \"Name\" : \"System.Object, mscorlib, Version=4.0.0.0, Culture=neutral, PublicKeyToken=b77a5c561934e089\", \"_bhomVersion\" : \"9.2\" }",
    m_ForcePreview=False,
    m_MaxItemsPreview=10000)
adapter_4 = BHoMAdapter(
    adapter,
    ObjectType="{ \"_t\" : \"System.Type\", \"Name\" : \"System.Object, mscorlib, Version=4.0.0.0, Culture=neutral, PublicKeyToken=b77a5c561934e089\", \"_bhomVersion\" : \"9.2\" }",
    m_ForcePreview=False,
    m_MaxItemsPreview=10000)
analyse = Analyse(Component="BH.oM.Adapter.Commands.Analyse")
pull = Pull(
    Adapter=adapter_3,
    Request=barresultrequest,
    PullType="{ \"_t\" : \"System.Enum\", \"TypeName\" : { \"_t\" : \"System.Type\", \"Name\" : \"BH.oM.Adapter.PullType\", \"_bhomVersion\" : \"9.2\" }, \"Value\" : \"AdapterDefault\", \"_bhomVersion\" : \"9.2\" }",
    Active=update_base_shear,
    Component="{ .Pull")
execute = Execute(Adapter=adapter_4, Command=analyse, Active=run_analysis, Component="{ .Execute")  # -> Output, Success
item_2 = ListItem(List=pull, Index=0, Wrap=True)
explode = Explode(Object=item_2, Component="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")  # -> AxialForce, FY, FZ, MX, MY, MZ, ObjectId, ResultCase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
panel_2 = Panel([explode.AxialForce, explode.FY, explode.FZ, explode.MX, explode.MY, explode.MZ])
