# Grasshopper definition 2D Frame-Test.gh (Grasshopper 1.0.7)
# plug-ins: BH.UI.Grasshopper

number_of_stories = Slider(4, range=4..10)
height_m = Slider(2, range=2..10)
width_m = Slider(2, range=2..10)

# ----
# Frame
dom = ConstructDomain(DomainStart=expr("-x/2", width_m), DomainEnd=expr("x/2", width_m))
pt = ConstructPoint(XCoordinate=expr("-x", dom), YCoordinate=0, ZCoordinate=0)
pt_2 = ConstructPoint(XCoordinate=dom, YCoordinate=0, ZCoordinate=0)
Z = UnitZ(Factor=height_m)
arrlinear = LinearArray(Geometry=[pt_2, pt], Direction=Z, Count=expr("x+1", number_of_stories))  # -> Geometry, Transform
cull_i = CullIndex(List=arrlinear.Geometry, Indices=0, Wrap=True)
flip = FlipMatrix(Data=cull_i)
dispatch = Dispatch(List=flip, DispatchPattern=[True, False])  # -> ListA, ListB
columns = PolyLine(Vertices=arrlinear.Geometry, Closed=False)
beams = Line(StartPoint=dispatch.ListA, EndPoint=dispatch.ListB)

toggle = BooleanToggle(False)

# ----
# Adapter
sectiondatabase = SectionDatabase(
    {"None": 0, "AISC14": 1, "AISC14M": 2, "AISC15": 3, "AISC15M": 4, "ArcelorMittal_British": 5, "ArcelorMittal_BritishHISTAR": 6, "ArcelorMittal_Europe": 7, "ArcelorMittal_EuropeHISTAR": 8, "ArcelorMittal_Japan": 9, "ArcelorMittal_Russia": 10, "ArcelorMittal_US_ASTM_A913": 11, "ArcelorMittal_US_ASTM_A913M": 12, "ArcelorMittal_US_ASTM_A992": 13, "ArcelorMittal_US_ASTM_A992M": 14, "Australia_NewZealand": 15, "BSShapes2006": 16, "ChineseGB08": 17, "CISC9": 18, "CISC10": 19, "CoreBraceBRB_2016": 20, "Euro": 21, "Indian": 22, "JIS_G_3192_2014": 23, "Nordic": 24, "Russian": 25, "SJIJoists": 26, "StarSeismicBRB": 27}, selected="None",
    Component="BH.oM.Adapters.ETABS.SectionDatabase",
    Selection=0)
panel = Panel("C:\Users\Tufail Mabood\Desktop\ETABs\2D Frame-Test-Modal Analysis.EDB")
databasesettings = DatabaseSettings(SectionDatabase=sectiondatabase, Component="BH.oM.Adapters.ETABS.DatabaseSettings")
etabssettings = EtabsSettings(
    ReplaceLoads=False,
    DatabaseSettings=databasesettings,
    EtabsVersion="{ \"_t\" : \"System.Enum\", \"TypeName\" : { \"_t\" : \"System.Type\", \"Name\" : \"BH.oM.Adapters.ETABS.EtabsVersion\", \"_bhomVersion\" : \"9.2\" }, \"Value\" : \"v18\", \"_bhomVersion\" : \"9.2\" }",
    Component="BH.oM.Adapters.ETABS.EtabsSettings")
etabs2016adapter = ETABS2016Adapter(FilePath=panel, EtabsSetting=etabssettings, Active=toggle, Component="{ ..ctor")
adapter = BHoMAdapter(
    etabs2016adapter,
    ObjectType="{ \"_t\" : \"System.Type\", \"Name\" : \"System.Object, mscorlib, Version=4.0.0.0, Culture=neutral, PublicKeyToken=b77a5c561934e089\", \"_bhomVersion\" : \"9.2\" }",
    m_ForcePreview=False,
    m_MaxItemsPreview=10000)

steel = Steel(
    {"S235": 0, "S275": 1, "S355": 2, "S450": 3}, selected="S355",
    Component="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",
    Selection=2)
tubeprofile = TubeProfile(Diameter=Slider(0.2, range=0.1..0.3), Thickness=Slider(0.01, range=0..0.01), Component="{ .TubeProfile")
tubeprofile_2 = TubeProfile(Diameter=Slider(0.2, range=0.1..0.3), Thickness=Slider(0.01, range=0..0.01), Component="{ .TubeProfile")
genericsectionfromprofile = GenericSectionFromProfile(Profile=tubeprofile_2, Material=steel, Component="{ .GenericSectionFromProfile")
genericsectionfromprofile_2 = GenericSectionFromProfile(Profile=tubeprofile, Material=steel, Component="{ .GenericSectionFromProfile")
barfeatype = BarFEAType(
    {"Flexural": 0, "Axial": 1, "CompressionOnly": 2, "TensionOnly": 3}, selected="Flexural",
    Component="BH.oM.Structure.Elements.BarFEAType",
    Selection=0)
barfeatype_2 = BarFEAType(
    {"Flexural": 0, "Axial": 1, "CompressionOnly": 2, "TensionOnly": 3}, selected="Flexural",
    Component="BH.oM.Structure.Elements.BarFEAType",
    Selection=0)
line = Line(columns)
line_2 = Line(beams)
bar = Bar(
    Line=flatten(line),
    SectionProperty=genericsectionfromprofile,
    OrientationAngle=0,
    FeaType=barfeatype,
    Name="Column",
    Component="{ .Bar")
bar_2 = Bar(
    Line=flatten(line_2),
    SectionProperty=genericsectionfromprofile_2,
    OrientationAngle=0,
    FeaType=barfeatype_2,
    Name="Beams",
    Component="{ .Bar")
pushtype = PushType(
    {"FullPush": 0, "CreateOnly": 1, "CreateNonExisting": 2, "UpdateOnly": 3, "UpdateOrCreateOnly": 4, "DeleteThenCreate": 5, "AdapterDefault": 6}, selected="CreateNonExisting",
    Component="BH.oM.Adapter.PushType",
    Selection=2)
merge = Merge(Data1=bar, Data2=bar_2)
adapter_2 = BHoMAdapter(
    adapter,
    ObjectType="{ \"_t\" : \"System.Type\", \"Name\" : \"System.Object, mscorlib, Version=4.0.0.0, Culture=neutral, PublicKeyToken=b77a5c561934e089\", \"_bhomVersion\" : \"9.2\" }",
    m_ForcePreview=False,
    m_MaxItemsPreview=10000)
push = Push(Adapter=adapter_2, Objects=flatten(merge), PushType=pushtype, Active=toggle, Component="{ .Push")  # -> Objects, Success
adapter_3 = BHoMAdapter(
    adapter,
    ObjectType="{ \"_t\" : \"System.Type\", \"Name\" : \"System.Object, mscorlib, Version=4.0.0.0, Culture=neutral, PublicKeyToken=b77a5c561934e089\", \"_bhomVersion\" : \"9.2\" }",
    m_ForcePreview=False,
    m_MaxItemsPreview=10000)
analyse = Analyse(Component="BH.oM.Adapter.Commands.Analyse")
execute = Execute(Adapter=adapter_3, Command=analyse, Active=Toggle(False), Component="{ .Execute")  # -> Output, Success
