# Grasshopper definition Create Bar Element in ETAB with User Defined Materials.gh (Grasshopper 1.0.7)
# plug-ins: Human, BH.UI.Grasshopper, LunchBox

concrete_database = Panel("C:\Users\Tufail Mabood\Desktop\ETABS-Grasshopper\gh\msefile\Concrete.xlsx")
steel_database = Panel("C:\Users\Tufail Mabood\Desktop\ETABS-Grasshopper\gh\msefile\Steel.xlsx")
sheets = Panel("""Concrete
Steel""")
toggle = BooleanToggle(True)
item = ListItem(List=sheets, Index=0, Wrap=True)  # -> Item, Item1
excelread = ExcelReader(ReadExcelData=toggle, WorkbookPath=concrete_database, WorksheetName=item.Item)  # -> Exceptions, simplify(ExcelData)
excelread_2 = ExcelReader(ReadExcelData=toggle, WorkbookPath=steel_database, WorksheetName=item.Item1)  # -> Exceptions, simplify(ExcelData)
viewer = ParamViewer(excelread.ExcelData)
viewer_2 = ParamViewer(excelread_2.ExcelData)
cull_i = CullIndex(List=excelread.ExcelData, Indices=0, Wrap=True)
cull_i_2 = CullIndex(List=excelread_2.ExcelData, Indices=0, Wrap=True)
bang = ExplodeTree(Data=cull_i)  # -> Branch0, Branch1, Branch2, Branch3, Branch4, Branch5, Branch6, Branch7
bang_2 = ExplodeTree(Data=cull_i_2)  # -> Branch0, Branch1, Branch2, Branch3, Branch4, Branch5, Branch6, Branch7
list = ItemSelector(
    bang.Branch0,
    {"Concrete_15MPa", "Concrete_16MPa", "Concrete_17MPa", "Concrete_18MPa", "Concrete_19MPa", "Concrete_20MPa", "Concrete_21MPa", "Concrete_22MPa", "Concrete_23MPa", "Concrete_24MPa"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}, selected="Concrete_15MPa")
list_2 = ItemSelector(
    bang_2.Branch0,
    {"A36", "A53GrB", "A500GrB_Rect", "A500GrB_Cir", "A572Gr50", "A913Gr50", "A992Fy50", "Grade40", "Grade60", "A615Gr75", "A706Gr60", "A416Gr250", "A416Gr270"}, selected="A992Fy50")
entwine = Entwine(
    Branch00=bang.Branch0,
    Branch01=bang.Branch1,
    Branch02=bang.Branch2,
    Branch03=bang.Branch3,
    Branch04=bang.Branch4,
    Branch05=bang.Branch5,
    Branch06=bang.Branch6,
    Branch07=bang.Branch7,
    FlattenInputs=True)
entwine_2 = Entwine(
    Branch00=bang_2.Branch0,
    Branch01=bang_2.Branch1,
    Branch02=bang_2.Branch2,
    Branch03=bang_2.Branch3,
    Branch04=bang_2.Branch4,
    Branch05=bang_2.Branch5,
    Branch06=bang_2.Branch6,
    Branch07=bang_2.Branch7,
    FlattenInputs=True)
mindex = MemberIndex(Set=flatten(cull_i), Member=list)  # -> Index, Count
item_2 = ListItem(List=entwine, Index=mindex.Index, Wrap=True)
mindex_2 = MemberIndex(Set=flatten(cull_i_2), Member=list_2)  # -> Index, Count
item_3 = ListItem(List=entwine_2, Index=mindex_2.Index, Wrap=True)
bang_3 = ExplodeTree(Data=item_2)  # -> Branch0, Branch1, Branch2, Branch3, Branch4, Branch5, Branch6, Branch7
bang_4 = ExplodeTree(Data=item_3)  # -> Branch0, Branch1, Branch2, Branch3, Branch4, Branch5, Branch6, Branch7
concrete = Concrete(
    Name=bang_3.Branch0,
    Density=bang_3.Branch1,
    DampingRatio=bang_3.Branch2,
    PoissonsRatio=bang_3.Branch3,
    ThermalExpansionCoeff=bang_3.Branch4,
    YoungsModulus=bang_3.Branch5,
    CylinderStrength=bang_3.Branch6,
    CubeStrength=bang_3.Branch7,
    Component="BH.oM.Structure.MaterialFragments.Concrete")
steel = Steel(
    Name=bang_4.Branch0,
    YoungsModulus=bang_4.Branch1,
    PoissonsRatio=bang_4.Branch2,
    ThermalExpansionCoeff=bang_4.Branch3,
    Density=bang_4.Branch4,
    DampingRatio=bang_4.Branch5,
    YieldStress=bang_4.Branch6,
    UltimateStress=bang_4.Branch7,
    Component="{ .Steel")

# ----
# Column Dimensions (ETAB US Customary Unit System)
# Linear Units = Input ft Output Meter
height_of_column_ft = Slider(11.5, range=5..15)
height_of_column_m = Slider(10, range=5..15)
expression = Expression(x=height_of_column_ft, Expression="x*0.3048")

# ----
# I have demonstrated Only T-Profile
section_dimensions = Panel("""0.2286
0.0181
0.1588
0.0176
0.00205
0.00205
Custom_TSec""")
bang_5 = ExplodeTree(Data=graft(section_dimensions))  # -> Branch0, Branch1, Branch2, Branch3, Branch4, Branch5, Branch6
steeltsection = SteelTSection(
    Height=bang_5.Branch0,
    WebThickness=bang_5.Branch1,
    FlangeWidth=bang_5.Branch2,
    FlangeThickness=bang_5.Branch3,
    RootRadius=bang_5.Branch4,
    ToeRadius=bang_5.Branch5,
    Material=steel,
    Name=bang_5.Branch6,
    Component="{ .SteelTSection")

doftype = DOFType(
    {"Free": 0, "Fixed": 1, "FixedNegative": 2, "FixedPositive": 3, "Spring": 4, "SpringNegative": 5, "SpringPositive": 6, "SpringRelative": 7, "SpringRelativeNegative": 8, "SpringRelativePositive": 9, "NonLinear": 10, "Friction": 11, "Damped": 12, "Gap": 13}, selected="Fixed",
    Component="BH.oM.Structure.Constraints.DOFType",
    Selection=1)
constraint6dof = Constraint6DOF(
    Name="Base",
    TranslationalStiffnessX=0,
    TranslationalStiffnessY=0,
    TranslationalStiffnessZ=0,
    RotationalStiffnessX=0,
    RotationalStiffnessY=0,
    RotationalStiffnessZ=0,
    TranslationX=doftype,
    TranslationY=doftype,
    TranslationZ=doftype,
    RotationX=doftype,
    RotationY=doftype,
    RotationZ=doftype,
    Component="BH.oM.Structure.Constraints.Constraint6DOF")
point = Point(X=0, Y=0, Z=expression, Component="{ .Point")
point_2 = Point(X=0, Y=0, Z=0, Component="{ .Point")
barfeatype = BarFEAType(
    {"Flexural": 0, "Axial": 1, "CompressionOnly": 2, "TensionOnly": 3}, selected="Flexural",
    Component="BH.oM.Structure.Elements.BarFEAType",
    Selection=0)
line = Line(Start=point_2, End=point, Infinite=False, Component="BH.oM.Geometry.Line")
barrelease = BarRelease(Name="Base", StartRelease=constraint6dof, Component="BH.oM.Structure.Constraints.BarRelease")
pushtype = PushType(
    {"FullPush": 0, "CreateOnly": 1, "CreateNonExisting": 2, "UpdateOnly": 3, "UpdateOrCreateOnly": 4, "DeleteThenCreate": 5, "AdapterDefault": 6}, selected="CreateNonExisting",
    Component="BH.oM.Adapter.PushType",
    Selection=2)
crv = Curve(line)
bar = Bar(
    Line=crv,
    SectionProperty=steeltsection,
    OrientationAngle=0,
    Release=barrelease,
    FeaType=barfeatype,
    Name="TCol",
    Component="{ .Bar")
etabs17adapter = ETABS17Adapter(Active=Toggle(True), Component="{ ..ctor")
push = Push(Adapter=etabs17adapter, Objects=flatten(bar), PushType=pushtype, Active=Toggle(True), Component="{ .Push")  # -> Objects, Success
explode = Explode(Object=bar, Component="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")  # -> Start, End, SectionProperty, OrientationAngle, Release, FEAType, Support, Offset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
