# Grasshopper definition L-Col-Test.gh (Grasshopper 1.0.7)
# plug-ins: BH.UI.Grasshopper

sectiondatabase = SectionDatabase(
    {"None": 0, "AISC14": 1, "AISC14M": 2, "AISC15": 3, "AISC15M": 4, "ArcelorMittal_British": 5, "ArcelorMittal_BritishHISTAR": 6, "ArcelorMittal_Europe": 7, "ArcelorMittal_EuropeHISTAR": 8, "ArcelorMittal_Japan": 9, "ArcelorMittal_Russia": 10, "ArcelorMittal_US_ASTM_A913": 11, "ArcelorMittal_US_ASTM_A913M": 12, "ArcelorMittal_US_ASTM_A992": 13, "ArcelorMittal_US_ASTM_A992M": 14, "Australia_NewZealand": 15, "BSShapes2006": 16, "ChineseGB08": 17, "CISC9": 18, "CISC10": 19, "CoreBraceBRB_2016": 20, "Euro": 21, "Indian": 22, "JIS_G_3192_2014": 23, "Nordic": 24, "Russian": 25, "SJIJoists": 26, "StarSeismicBRB": 27}, selected="AISC14",
    Component="BH.oM.Adapters.ETABS.SectionDatabase",
    Selection=1)
barfeatype = BarFEAType(
    {"Flexural": 0, "Axial": 1, "CompressionOnly": 2, "TensionOnly": 3}, selected="Flexural",
    Component="BH.oM.Structure.Elements.BarFEAType",
    Selection=0)
L = L(
    {"L 200x150x18.0": 0, "L 200x150x15.0": 1, "L 200x150x12.0": 2, "L 200x100x15.0": 3, "L 200x100x12.0": 4, "L 200x100x10.0": 5, "L 150x90x15.0": 6, "L 150x90x12.0": 7, "L 150x90x10.0": 8, "L 150x75x15.0": 9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}, selected="L 200x150x18.0",
    Component="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",
    Selection=0)
line = LineSDL(Start="0,0,0", Direction=Vector(0, 0, 1), Length=Slider(10, range=0..10))
end = EndPoints(Curve=line)  # -> Start, End
databasesettings = DatabaseSettings(SectionDatabase=sectiondatabase, Component="BH.oM.Adapters.ETABS.DatabaseSettings")
line_2 = Line(Start=end.Start, End=end.End, Component="{ .Line")
fixconstraint6dof = FixConstraint6DOF(Name="Fix", Component="{ .FixConstraint6DOF")
bar = Bar(Line=line_2, SectionProperty=L, OrientationAngle=0, FeaType=barfeatype, Name="Column", Component="{ .Bar")
etabssettings = EtabsSettings(
    ReplaceLoads=False,
    DatabaseSettings=databasesettings,
    EtabsVersion="{ \"_t\" : \"System.Enum\", \"TypeName\" : { \"_t\" : \"System.Type\", \"Name\" : \"BH.oM.Adapters.ETABS.EtabsVersion\", \"_bhomVersion\" : \"9.2\" }, \"Value\" : \"v18\", \"_bhomVersion\" : \"9.2\" }",
    Component="BH.oM.Adapters.ETABS.EtabsSettings")
node = Node(Position=end.Start, Support=fixconstraint6dof, Name="Base Node", Component="BH.oM.Structure.Elements.Node")
pushtype = PushType(
    {"FullPush": 0, "CreateOnly": 1, "CreateNonExisting": 2, "UpdateOnly": 3, "UpdateOrCreateOnly": 4, "DeleteThenCreate": 5, "AdapterDefault": 6}, selected="CreateNonExisting",
    Component="BH.oM.Adapter.PushType",
    Selection=2)
toggle = BooleanToggle(False)
etabs2016adapter = ETABS2016Adapter(FilePath="C:\Users\Tufail Mabood\Desktop\ETABs\Col.EDB", EtabsSetting=etabssettings, Active=toggle, Component="{ ..ctor")
merge = Merge(Data1=bar, Data2=node)
analyse = Analyse(Component="BH.oM.Adapter.Commands.Analyse")
push = Push(Adapter=etabs2016adapter, Objects=flatten(merge), PushType=pushtype, Active=toggle, Component="{ .Push")  # -> Objects, Success
execute = Execute(Adapter=etabs2016adapter, Command=analyse, Active=toggle, Component="{ .Execute")  # -> Output, Success
