# Grasshopper definition Push Load Factors and Combinations to ETAB 2017.gh (Grasshopper 1.0.7)
# plug-ins: Human, BH.UI.Grasshopper, LunchBox

# WhatsApp: +923440907874
#                        +923400740460
# Email: Tufail_mabood@yahoo.com
# Github: https://github.com/tufailmab
panel = Panel("C:\Users\Tufail Mabood\Desktop\ETABS-Grasshopper\gh\Load Factors and Combinations\Load Cases and Combinations\LCases and Combinations.xlsx")
excelread = ExcelReader(ReadExcelData=Toggle(True), WorkbookPath=panel, WorksheetName="Load Combinations")  # -> Exceptions, ExcelData
cull_i = CullIndex(List=excelread.ExcelData, Indices=0, Wrap=True)
flip = FlipMatrix(Data=cull_i)
item = ListItem(List=flip, Index=0, Wrap=True)  # -> flatten(Item), Item1, Item2
tsort = SortText(Keys=item.Item, Culture=127)  # -> reverse(Keys), Values
panel_2 = Panel("""+
*""")
dcon = DeleteConsecutive(Set=tsort.Keys, Wrap=False)  # -> flatten(Set), Count
rep = ReplaceText(Text=dcon.Set, Find="-", Replace="+-", RecursiveReplace=False)
split = TextSplit(Text=rep, Separators=panel_2)
trim = TextTrim(Text=split, Start=True, End=True)

# ----
# For Each Load Case Update!
loadnature = LoadNature(
    {"Dead": 0, "SuperDead": 1, "Live": 2, "Wind": 3, "Seismic": 4, "Temperature": 5, "Snow": 6, "Accidental": 7, "Prestress": 8, "Notional": 9, "Other": 10}, selected="Dead",
    Component="BH.oM.Structure.Loads.LoadNature",
    Selection=0)
loadnature_2 = LoadNature(
    {"Dead": 0, "SuperDead": 1, "Live": 2, "Wind": 3, "Seismic": 4, "Temperature": 5, "Snow": 6, "Accidental": 7, "Prestress": 8, "Notional": 9, "Other": 10}, selected="SuperDead",
    Component="BH.oM.Structure.Loads.LoadNature",
    Selection=1)
loadnature_3 = LoadNature(
    {"Dead": 0, "SuperDead": 1, "Live": 2, "Wind": 3, "Seismic": 4, "Temperature": 5, "Snow": 6, "Accidental": 7, "Prestress": 8, "Notional": 9, "Other": 10}, selected="Live",
    Component="BH.oM.Structure.Loads.LoadNature",
    Selection=2)
list = ItemSelector(
    dcon.Set,
    {"1.40D", "1.20D+1.60S+1.00L", "1.20D+1.60Lr+1.00L", "1.20D+1.60L+0.50S", "1.20D+1.60L+0.50Lr", "1.20D+1.00L+0.50Lr-1.00WY", "1.20D+1.00L+0.50Lr-1.00WX", "1.20D+1.00L+0.50Lr+1.00WY", "1.20D+1.00L+0.50Lr+1.00WX", "1.20D+1.00L+0.20S-1.00EQY", "1.20D+1.00L+0.20S-1.00EQX", "1.20D+1.00L+0.20S+1.00EQY", "1.20D+1.00L+0.20S+1.00EQX", "0.90D-1.00WY", "0.90D-1.00WX", "0.90D-1.00EQY", "0.90D-1.00EQX", "0.90D+1.00WY", "0.90D+1.00WX", "0.90D+1.00EQY", "0.90D+1.00EQX"}, selected="1.20D+1.60S+1.00L")
loadcase = Loadcase(Name=loadnature, Nature=loadnature, Component="BH.oM.Structure.Loads.Loadcase")
loadcase_2 = Loadcase(Name=loadnature_2, Nature=loadnature_2, Component="BH.oM.Structure.Loads.Loadcase")
loadcase_3 = Loadcase(Name=loadnature_3, Nature=loadnature_3, Component="BH.oM.Structure.Loads.Loadcase")
merge = Merge(Data1=loadcase, Data2=loadcase_2, Data3=loadcase_3)

mindex = MemberIndex(Set=dcon.Set, Member=list)  # -> Index, Count
fragment = TextFragment(Text=trim, Start="0", Count="4")
concat = Concatenate(FragmentC="{", FragmentA="0", FragmentB=";", FragmentB_2=mindex.Index, FragmentA_2="}")
branch = TreeBranch(Tree=fragment, Path=concat, MaintainPaths=True)
etabs17adapter = ETABS17Adapter(Active=Toggle(True), Component="{ ..ctor")
flip_2 = FlipMatrix(Data=branch)
pushtype = PushType(
    {"FullPush": 0, "CreateOnly": 1, "CreateNonExisting": 2, "UpdateOnly": 3, "UpdateOrCreateOnly": 4, "DeleteThenCreate": 5, "AdapterDefault": 6}, selected="CreateNonExisting",
    Component="BH.oM.Adapter.PushType",
    Selection=2)
loadcombination = LoadCombination(Name=list, Number="1", Cases=merge, Factors=flatten(flip_2), ExcludeZeroFactorCases=True, Component="{ .LoadCombination")
merge_2 = Merge(Data1=merge, Data2=loadcombination)
push = Push(Adapter=etabs17adapter, Objects=flatten(merge_2), PushType=pushtype, Active=Toggle(True), Component="{ .Push")  # -> Objects, Success
