# Grasshopper definition Template for Grids and Slabs.gh (Grasshopper 1.0.7)

# ----
# All Inputs for Geometry
building_lx_ft = Slider(59, range=24..72)
building_ly_ft = Slider(72, range=24..72)
bays_along_x_direction = Slider(4, range=3..5)
bays_along_y_direction = Slider(3, range=3..5)
story_height_ft = Slider(9, range=9..12)
choose_location_of_stairs = Slider(0.6, range=0..1)
number_of_stories = Slider(5, range=5..10)

# ----
# Modeling a 10-Story Building with Grasshopper, ETABS, and BHoM
# WhatsApp: +923440907874, +923400740460
xy = XYPlane(Origin=Point(0, 0, 0))

# ----
# Conversion to Meters
expression = Expression(x=building_lx_ft, Expression="x*0.3048")
expression_2 = Expression(x=building_ly_ft, Expression="x*0.3048")

rectangle = Rectangle(Plane=xy, XSize=expression, YSize=expression_2, Radius=0)  # -> Rectangle, Length
debrep = DeconstructBrep(Brep=rectangle.Rectangle)  # -> Faces, Edges, Vertices
item = ListItem(List=debrep.Edges, Index=0, Wrap=True)  # -> Item, Item1, Item2, Item3
boundary = BoundarySurfaces(Edges=rectangle.Rectangle)
divide = DivideCurve(Curve=[item.Item, item.Item2], Count=bays_along_x_direction, Kinks=False)  # -> Points, Tangents, Parameters
divide_2 = DivideCurve(Curve=[item.Item1, item.Item3], Count=bays_along_y_direction, Kinks=False)  # -> Points, Tangents, Parameters
split = SplitList(List=flatten(divide.Points), Index=expr("X+1", bays_along_x_direction))  # -> ListA, ListB
split_2 = SplitList(List=flatten(divide_2.Points), Index=expr("X+1", bays_along_y_direction))  # -> ListA, ListB
expression_3 = Expression(x=story_height_ft, Expression="x*0.3048")
ln = Line(StartPoint=reverse(split.ListA), EndPoint=split.ListB)
ln_2 = Line(StartPoint=reverse(split_2.ListA), EndPoint=split_2.ListB)
srfsplit = SurfaceSplit(Surface=boundary, Curves=flatten([ln, ln_2]))
lng = ListLength(List=srfsplit)
multiplication = Multiplication(A=lng, B=choose_location_of_stairs)
int = Integer(multiplication)
Z = UnitZ(Factor=expression_3)
multiplication_2 = Multiplication(A=number_of_stories, B=expression_3)
item_2 = ListItem(List=flatten(srfsplit), Index=int, Wrap=True)
ccx = CurveCurve(CurveA=graft(ln), CurveB=flatten(ln_2))  # -> Points, ParamsA, ParamsB
Z_2 = UnitZ(Factor=multiplication_2)
arrlinear = LinearArray(Geometry=[ln, ln_2], Direction=Z, Count=expr("x+1", number_of_stories))  # -> Geometry, Transform
X = UnitX(Factor=1)
area = Area(Geometry=srfsplit)  # -> Area, Centroid
line = LineSDL(Start=ccx.Points, Direction=Z_2, Length=multiplication_2)
area_2 = Area(Geometry=item_2)  # -> Area, Centroid
cull_i = CullIndex(List=arrlinear.Geometry, Indices=0, Wrap=True)
dprod = DotProduct(VectorA=flatten(cull_i), VectorB=X, Unitize=True)
dprod_2 = DotProduct(VectorA=flatten(cull_i), VectorB=X, Unitize=True)
divide_3 = DivideCurve(Curve=line, Count=number_of_stories, Kinks=False)  # -> Points, Tangents, Parameters
dist = Distance(PointA=area.Centroid, PointB=area_2.Centroid)
abs = Absolute(Value=dprod)
abs_2 = Absolute(Value=dprod_2)
equals = Equality(FirstNumber=dist, SecondNumber=0)  # -> Equality, Inequality
equals_2 = Equality(FirstNumber=abs, SecondNumber=0)  # -> Equality, Inequality
equals_3 = Equality(FirstNumber=abs_2, SecondNumber=0)  # -> Equality, Inequality

# ----
# All Columns
shatter = Shatter(Curve=line, Parameters=divide_3.Parameters)

cull = CullPattern(List=srfsplit, CullPattern=equals.Inequality)

# ----
# Beams Along X Direction
# Beams Along Y Direction
cull_2 = CullPattern(List=flatten(cull_i), CullPattern=equals_2.Equality)
cull_3 = CullPattern(List=flatten(cull_i), CullPattern=equals_3.Inequality)

arrlinear_2 = LinearArray(Geometry=cull, Direction=Z, Count=expr("x+1", number_of_stories))  # -> Geometry, Transform
ccx_2 = CurveCurve(CurveA=flatten(cull_2), CurveB=graft(cull_3))  # -> Points, ParamsA, ParamsB

# ----
# All Slabs
cull_i_2 = CullIndex(List=arrlinear_2.Geometry, Indices=0, Wrap=True)

shatter_2 = Shatter(Curve=cull_2, Parameters=flatten(ccx_2.ParamsA))
shatter_3 = Shatter(Curve=cull_3, Parameters=flatten(ccx_2.ParamsB))

# ----
# Geometric Inputs
# for BHoM
beams_x_direction = Curve(flatten(shatter_2))
beams_y_direction = Curve(flatten(shatter_3))
all_columns = Curve(flatten(shatter))
all_slabs = Surface(flatten(cull_i_2))
base = Point(flatten(ccx.Points))
