# Grasshopper definition Source File.gh (Grasshopper 1.0.7)
# plug-ins: Pufferfish, Human, BH.UI.Grasshopper, LunchBox, Kangaroo2 Components

# ----
# Template - Main ETAB Controls
link_etab_2017 = BooleanToggle(False)
create_load_patterns = BooleanToggle(False)
create_load_combinations = BooleanToggle(False)
get_all_load_cases = BooleanToggle(False)
apply_all_modifiers = BooleanToggle(True)
send_model_to_etab_2017_quick_mesh = BooleanToggle(False)
set_design_preferences_for_beams = ValueList({"P-M2-M3 Design (Column)": 0, "M3 Design Only (Beam)": 1}, selected="M3 Design Only (Beam)")
analyse_model_in_etab_delete_model_case = BooleanToggle(False)  # "Analyse Model in ETAB (Delete Model Case First)"

# ----
# All Inputs for Geometry (Constant Due to Shear Walls) Do Not Change Bays Numbers
building_lx_ft = Slider(108, range=24..108)
building_ly_ft = Slider(72, range=24..72)
bays_along_x_direction = Slider(9, range=3..9)
bays_along_y_direction = Slider(3, range=3..5)
story_height_ft = Slider(12, range=9..12)
choose_location_of_stairs = Slider(0.78, range=0..1)
number_of_stories = Slider(10, range=2..10)
# From the mass participation and the time period, as well as from UBC 97 and BCP, it is now clear that the building is very flexible and have a high time period. Since it is structurally not safe (Mode 1, 2 and 3). The soft spot in this building is Along Y-Axis. I delibratly not changed the column sizes so that i see how this building talk with me... Anyhow let's add walls in it. Look at the first 3 modes.
# 
# I am going to add walls in this direction. Assume that there is a restriction on increasing the Column Size... :/
mumty_height_ft = Slider(9, range=9..12)

# ----
# Modeling a 10-Story Building with Grasshopper, ETABS, and BHoM
# WhatsApp: +923440907874, +923400740460
# Template -Create Independent Load Cases and Combinations
# Run Before Executing ETAB with BHoM
# Backup
# Type: Dead
# Super Dead
# Live
# Roof Live
# Snow
# Seismic
# Seismic
# Wind
# Wind
# Super Dead
# Super Dead
# Super Dead
# Super Dead
# Super Dead
# Super Dead
load = Panel("""DEAD
SDL
LIVE
ROOF LIVE
SNOW
EQX
EQY
WX
WY
SDL_Parapet
SDL_Cladding
SDL_Partitions
SDL_Finishes
SDL_Roofing
SDL_MEP""")
self_weight_multiplier = Panel("""1
0
0
0
0
0
0
0
0
0
0
0
0
0
0""")

assign_names_to_piers = BooleanToggle(False)

assign_names_to_piers_etab_api = GhPythonScript(Run=assign_names_to_piers)  # -> flatten(Status)
# ---------- assign_names_to_piers_etab_api: Python ----------
import clr
clr.AddReference("ETABSv17")
import ETABSv17
import System
import math

helper = ETABSv17.Helper()
etabs = helper.GetObject("CSI.ETABS.API.ETABSObject")
SapModel = etabs.SapModel

Status = []
PierNames = []

if not Run:

    Status.append("Run = False -- nothing executed.")
    Status.append("Set Run = True to assign Pier labels to walls (property: SW).")

else:

    # ========================================================
    # SETTINGS
    # ========================================================

    WALL_PROPERTY = "SW"
    XY_TOL = 0.05
    ANGLE_TOL = 2.0

    Status.append("Wall property: " + WALL_PROPERTY)


    # ========================================================
    # HELPERS
    # ========================================================

    def empty_string_array():
        return System.Array.CreateInstance(System.String, 0)


    def get_area_property(area_name):
        try:
            prop_ref = clr.Reference[System.String]("")
            ret = SapModel.AreaObj.GetProperty(area_name, prop_ref)
            if isinstance(ret, tuple):
                if len(ret) >= 2:
                    return (int(ret[0]), str(ret[1]))
            return (int(ret), str(prop_ref.Value))
        except:
            return (-1, "")


    def get_area_points(area_name):
        try:
            number_points_ref = clr.Reference[System.Int32](0)
            empty_arr = System.Array.CreateInstance(System.String, 0)
            point_names_ref = clr.Reference[System.Array[System.String]](empty_arr)
            ret = SapModel.AreaObj.GetPoints(area_name, number_points_ref, point_names_ref)
            ret_code = int(ret[0]) if isinstance(ret, tuple) else int(ret)
            if ret_code != 0:
                return None
            point_names = point_names_ref.Value
            if point_names is None:
                return None
            result = [str(p) for p in point_names]
            return result if len(result) > 0 else None
        except:
            return None


    def get_point_coordinates(point_name):
        try:
            x_ref = clr.Reference[System.Double](0.0)
            y_ref = clr.Reference[System.Double](0.0)
            z_ref = clr.Reference[System.Double](0.0)
            ret = SapModel.PointObj.GetCoordCartesian(point_name, x_ref, y_ref, z_ref)
            ret_code = int(ret[0]) if isinstance(ret, tuple) else int(ret)
            if ret_code != 0:
                return None
            return (float(x_ref.Value), float(y_ref.Value), float(z_ref.Value))
        except:
            return None


    def distance_xy(p1, p2):
        dx = p1[0] - p2[0]
        dy = p1[1] - p2[1]
        return math.sqrt(dx * dx + dy * dy)


    def point_line_distance(point, p1, p2):
        x, y = point[0], point[1]
        x1, y1 = p1[0], p1[1]
        x2, y2 = p2[0], p2[1]
        dx = x2 - x1
        dy = y2 - y1
        length = math.sqrt(dx * dx + dy * dy)
        if length < 1e-6:
            return 999999.0
        return abs(dx * (y1 - y) - (x1 - x) * dy) / length


    # ========================================================
    # AREA LIST
    # ========================================================

    area_names_ref = empty_string_array()
    result = SapModel.AreaObj.GetNameList(0, area_names_ref)

    if not isinstance(result, tuple):
        raise Exception("Unable to read Area Object list.")

    ret = int(result[0])
    NumAreas = int(result[1])
    AreaNames = result[2]

    if ret != 0:
        raise Exception("AreaObj.GetNameList failed: %s" % ret)

    Status.append("Total Area Objects: %d" % NumAreas)


    # ========================================================
    # PROPERTIES + WALL FILTER
    # ========================================================

    area_properties = {}
    wall_areas = []

    for area_name in AreaNames:
        ret_prop, prop_name = get_area_property(area_name)
        if ret_prop == 0:
            prop_name = str(prop_name).strip()
            area_properties[area_name] = prop_name
            if prop_name == WALL_PROPERTY:
                wall_areas.append(area_name)

    Status.append("Wall Areas: %d" % len(wall_areas))

    if len(wall_areas) == 0:
        Status.append("NO WALLS DETECTED.")
        raise Exception("No wall Area Objects use property SW.")


    # ========================================================
    # WALL GEOMETRY
    # ========================================================

    wall_data = []
    geometry_errors = 0

    for area_name in wall_areas:

        point_names = get_area_points(area_name)
        if point_names is None:
            geometry_errors += 1
            continue

        coords = []
        for point_name in point_names:
            xyz = get_point_coordinates(point_name)
            if xyz is not None:
                coords.append(xyz)

        if len(coords) < 2:
            geometry_errors += 1
            continue

        longest_length = 0.0
        line_p1 = None
        line_p2 = None
        n = len(coords)

        for i in range(n):
            p1 = coords[i]
            p2 = coords[(i + 1) % n]
            length = distance_xy(p1, p2)
            if length > longest_length:
                longest_length = length
                line_p1 = p1
                line_p2 = p2

        if line_p1 is None:
            geometry_errors += 1
            continue

        cx = sum(p[0] for p in coords) / len(coords)
        cy = sum(p[1] for p in coords) / len(coords)
        cz = sum(p[2] for p in coords) / len(coords)
        min_z = min(p[2] for p in coords)
        max_z = max(p[2] for p in coords)

        dx = line_p2[0] - line_p1[0]
        dy = line_p2[1] - line_p1[1]
        angle_deg = math.atan2(dy, dx) * 180.0 / math.pi
        if angle_deg < 0:
            angle_deg += 180.0
        if angle_deg >= 180.0:
            angle_deg -= 180.0

        wall_data.append({
            "name": area_name,
            "p1": line_p1,
            "p2": line_p2,
            "cx": cx, "cy": cy, "cz": cz,
            "min_z": min_z, "max_z": max_z,
            "angle": angle_deg,
            "length": longest_length
        })

    Status.append("Wall Geometries: %d (errors: %d)" % (len(wall_data), geometry_errors))

    if len(wall_data) == 0:
        raise Exception("GetPoints failed for all wall areas.")


    # ========================================================
    # CONNECTIVITY
    # ========================================================

    def walls_connected(w1, w2):

        diff = abs(w1["angle"] - w2["angle"])
        if diff > 90.0:
            diff = 180.0 - diff
        if diff > ANGLE_TOL:
            return False

        d1 = point_line_distance(w2["p1"], w1["p1"], w1["p2"])
        d2 = point_line_distance(w2["p2"], w1["p1"], w1["p2"])
        if d1 > XY_TOL and d2 > XY_TOL:
            return False

        angle = w1["angle"] * math.pi / 180.0
        ux = math.cos(angle)
        uy = math.sin(angle)

        def project(point):
            return point[0] * ux + point[1] * uy

        a1, a2 = project(w1["p1"]), project(w1["p2"])
        b1, b2 = project(w2["p1"]), project(w2["p2"])

        a_min, a_max = min(a1, a2), max(a1, a2)
        b_min, b_max = min(b1, b2), max(b1, b2)

        return b_min <= a_max + XY_TOL and b_max >= a_min - XY_TOL


    # ========================================================
    # GROUPING
    # ========================================================

    groups = []

    for wall in wall_data:
        found = False
        for group in groups:
            for existing in group:
                if walls_connected(wall, existing):
                    group.append(wall)
                    found = True
                    break
            if found:
                break
        if not found:
            groups.append([wall])

    changed = True
    while changed:
        changed = False
        i = 0
        while i < len(groups):
            j = i + 1
            while j < len(groups):
                should_merge = False
                for wall1 in groups[i]:
                    for wall2 in groups[j]:
                        if walls_connected(wall1, wall2):
                            should_merge = True
                            break
                    if should_merge:
                        break
                if should_merge:
                    groups[i].extend(groups[j])
                    del groups[j]
                    changed = True
                else:
                    j += 1
            i += 1

    def group_sort_key(group):
        cx = sum(w["cx"] for w in group) / len(group)
        cy = sum(w["cy"] for w in group) / len(group)
        return (round(cx, 3), round(cy, 3))

    groups.sort(key=group_sort_key)

    Status.append("Pier Groups: %d" % len(groups))


    # ========================================================
    # ASSIGN PIERS
    # ========================================================

    total_assigned = 0
    total_failed = 0

    for idx, group in enumerate(groups):

        pier_name = "P_%d" % (idx + 1)

        try:
            SapModel.PierLabel.SetPier(pier_name)
        except Exception as e:
            Status.append("ERROR creating %s: %s" % (pier_name, str(e)))
            continue

        for wall in group:
            try:
                ret_assign = SapModel.AreaObj.SetPier(wall["name"], pier_name)
                if ret_assign == 0:
                    total_assigned += 1
                else:
                    total_failed += 1
            except:
                total_failed += 1

        PierNames.append(pier_name)


    # ========================================================
    # SUMMARY
    # ========================================================

    Status.append("Assigned: %d | Failed: %d" % (total_assigned, total_failed))
    Status.append("Piers: %s" % ", ".join(PierNames))


print("\n".join(Status))
# ---------- end assign_names_to_piers_etab_api ----------
panel = Panel(assign_names_to_piers_etab_api)

# ----
# Create Load Patterns (ETAB API):
# Run Once the Model is Linked with BHoM
# Onces the Load Patterns are generated, Switch Boolean to False
load_2 = Panel("""DEAD
SDL
LIVE
EQx
EQy
Wx
Wy""")
type = Panel("""Dead
Super Dead
Live
Seismic
Seismic
Wind
Wind""")
self_weight_multiplier_2 = Panel("""1
0
0
0
0
0
0""")
create_load_pattern_etab_2017_api = GhPythonScript(Names=load_2, Types=type, SelfWeight=self_weight_multiplier_2, Run=create_load_patterns)  # -> Status, Model; inputs Names: list, Types: list, SelfWeight: list
# ---------- create_load_pattern_etab_2017_api: Python ----------
import clr
import System

# =========================================================
# ETABS 2017 API
# =========================================================

clr.AddReference("ETABSv17")
import ETABSv17


Status = []
Model = None


# =========================================================
# WAIT FOR RUN
# =========================================================

if not Run:

    Status.append("Waiting for Run = True")


else:

    # =====================================================
    # CONNECT TO RUNNING ETABS
    # =====================================================

    try:

        Status.append("Connecting to running ETABS...")

        helper = ETABSv17.Helper()

        Status.append("ETABS Helper created")

        ETABSObject = helper.GetObject(
            "CSI.ETABS.API.ETABSObject"
        )

        Status.append("ETABS application connected")

        Model = ETABSObject.SapModel

        Status.append("SapModel connected")


    except Exception as e:

        Status.append("ERROR connecting to ETABS:")
        Status.append(str(e))


    # =====================================================
    # CREATE LOAD PATTERNS
    # =====================================================

    if Model is not None:

        try:

            # -------------------------------------------------
            # CHECK INPUT LENGTHS
            # -------------------------------------------------

            if len(Names) != len(Types):

                Status.append(
                    "ERROR: Names and Types have different lengths"
                )

            elif len(Names) != len(SelfWeight):

                Status.append(
                    "ERROR: Names and SelfWeight have different lengths"
                )

            else:

                Status.append(
                    "Creating {} load patterns...".format(
                        len(Names)
                    )
                )


                # =================================================
                # LOAD PATTERN LOOP
                # =================================================

                for i in range(len(Names)):

                    name = str(Names[i]).strip()
                    type_name = str(Types[i]).strip()
                    self_weight = float(SelfWeight[i])


                    try:

                        # -----------------------------------------
                        # NORMALIZE LOAD TYPE
                        # -----------------------------------------

                        type_lower = type_name.lower()


                        if type_lower == "dead":

                            enum_name = "Dead"

                        elif type_lower == "super dead":

                            enum_name = "SuperDead"

                        elif type_lower == "live":

                            enum_name = "Live"

                        elif type_lower == "roof live":

                            enum_name = "RoofLive"

                        elif type_lower == "wind":

                            enum_name = "Wind"

                        elif type_lower == "quake":

                            enum_name = "Quake"

                        elif type_lower == "seismic":

                            enum_name = "Quake"

                        elif type_lower == "snow":

                            enum_name = "Snow"

                        elif type_lower == "other":

                            enum_name = "Other"

                        else:

                            enum_name = type_name


                        # -----------------------------------------
                        # CONVERT TO ETABS ENUM
                        # -----------------------------------------

                        load_type = System.Enum.Parse(
                            ETABSv17.eLoadPatternType,
                            enum_name,
                            True
                        )


                        # -----------------------------------------
                        # ADD LOAD PATTERN
                        # -----------------------------------------

                        ret = Model.LoadPatterns.Add(
                            name,
                            load_type,
                            self_weight,
                            True
                        )


                        # -----------------------------------------
                        # CHECK RESULT
                        # -----------------------------------------

                        if ret == 0:

                            Status.append(
                                "SUCCESS: {} | Type: {} | SW: {}".format(
                                    name,
                                    type_name,
                                    self_weight
                                )
                            )

                        elif ret == 1:

                            Status.append(
                                "EXISTS/NOT ADDED: {} | Type: {} | API code 1".format(
                                    name,
                                    type_name
                                )
                            )

                        else:

                            Status.append(
                                "FAILED: {} | Type: {} | API code {}".format(
                                    name,
                                    type_name,
                                    ret
                                )
                            )


                    except Exception as e:

                        Status.append(
                            "ERROR creating {} | Type {}: {}".format(
                                name,
                                type_name,
                                str(e)
                            )
                        )


                # =================================================
                # FINISHED
                # =================================================

                Status.append(
                    "-----------------------------"
                )

                Status.append(
                    "Finished."
                )


        except Exception as e:

            Status.append(
                "ERROR during load pattern creation:"
            )

            Status.append(str(e))
# ---------- end create_load_pattern_etab_2017_api ----------
if_load_pattern_exist_with_same_name_thi = Panel(create_load_pattern_etab_2017_api.Status)  # "If Load Pattern Exist with Same Name, This will Skip That Load Pattern"
panel_2 = Panel(create_load_pattern_etab_2017_api.Model)

# ----
# Template - Concrete and Steel Rebars Materials
concrete_database = Panel("C:\Users\Tufail Mabood\Desktop\ETABS-Grasshopper\gh\msefile\Concrete.xlsx")
steel_database = Panel("C:\Users\Tufail Mabood\Desktop\ETABS-Grasshopper\gh\msefile\Steel.xlsx")
read_data_from_concrete_and_steel_databa = BooleanToggle(True)  # "Read Data from Concrete and Steel Database"

# ----
# Story Data in ETAB
# Note: We need to add stories. It is important for Lateral Loads
x_plus_one = XPlusOne(NumberX=number_of_stories)
# Grids and Stories Definitions for ETAB (Specific to this project Only)
series = Series(Start=0, Step=story_height_ft, Count=x_plus_one)
bnd = Bounds(Numbers=series)
series_2 = Series(Start=story_height_ft, Step=0, Count=number_of_stories)
dedomain = DeconstructDomain(Domain=bnd)  # -> Start, End
entwine = Entwine(Branch00="0", Branch01=series_2, FlattenInputs=True)  # -> flatten(Result)
addition = Addition(A=mumty_height_ft, B=dedomain.End)
entwine_2 = Entwine(Branch00=flatten(entwine), Branch01=flatten(mumty_height_ft), FlattenInputs=True)  # -> flatten(Result)
entwine_3 = Entwine(Branch00=series, Branch01=addition, FlattenInputs=True)  # -> simplify(flatten(Result))
ma = MassAddition(Input=entwine_2)  # -> Result, reverse(PartialResults)
data = Data(reverse(entwine_3))
panel_3 = Panel(data)
panel_4 = Panel(ma.PartialResults)

# ----
# Link ETAB and Analyse Model (NVImp for Template)
# If Model is Not Linked, the existing ETAB Window will be Linked (Preffered Choice)
# Always Launch ETAB model first.
etabs17adapter = ETABS17Adapter(Active=link_etab_2017, Component="{ ..ctor")
analyse = Analyse(Component="BH.oM.Adapter.Commands.Analyse")
execute = Execute(Adapter=etabs17adapter, Command=analyse, Active=analyse_model_in_etab_delete_model_case, Component="{ .Execute")  # -> Output, Success

# ----
# To be Updated for BCP-2007
create_load_combinations_etab_2017_api = GhPythonScript(Run=create_load_combinations)  # -> Renamed_Combinations, Error_Messages, Concrete_Gen_Return, Total_Renamed, Total_Design_Combos, Log_Messages
# ---------- create_load_combinations_etab_2017_api: Python ----------
import clr
clr.AddReference("ETABSv17")
import ETABSv17
import System

# ============================================================
# CONNECT TO RUNNING ETABS
# ============================================================

helper = ETABSv17.Helper()
etabs = helper.GetObject("CSI.ETABS.API.ETABSObject")
SapModel = etabs.SapModel

# ============================================================
# OUTPUT / LOGGING
# ============================================================

created = []
errors = []
log = []

# ============================================================
# 1. GENERATE DEFAULT DESIGN COMBOS (if needed)
# ============================================================

gen_ret_steel = SapModel.RespCombo.AddDesignDefaultCombos(True, False, False, False)
gen_ret_concrete = SapModel.RespCombo.AddDesignDefaultCombos(False, True, False, False)
gen_ret_aluminum = SapModel.RespCombo.AddDesignDefaultCombos(False, False, True, False)
gen_ret_cold = SapModel.RespCombo.AddDesignDefaultCombos(False, False, False, True)

log.append("Steel combos generation return = " + str(gen_ret_steel))
log.append("Concrete combos generation return = " + str(gen_ret_concrete))
log.append("Aluminum combos generation return = " + str(gen_ret_aluminum))
log.append("Cold Formed combos generation return = " + str(gen_ret_cold))

# ============================================================
# 2. GET ALL COMBINATION NAMES FROM ETABS
# ============================================================

names_array = System.Array.CreateInstance(System.String, 0)
ret_val, name_count, names = SapModel.RespCombo.GetNameList(0, names_array)

if ret_val != 0:
    errors.append("GetNameList failed: " + str(ret_val))
else:
    all_names = []
    for i in range(name_count):
        all_names.append(names[i])
    
    log.append("Total response combinations = " + str(len(all_names)))
    
    # ============================================================
    # 3. FIND ALL DESIGN COMBOS
    # ============================================================
    
    design_prefixes = ["DCON", "DWAL", "DSLBU", "DSTLS", "DSTLD", "DCMP"]
    user_prefixes = ["UDCON", "UDWAL", "UDSLBU", "UDSTL"]
    all_prefixes = design_prefixes + user_prefixes
    
    dcons = []
    
    for name in all_names:
        name_upper = name.upper()
        for prefix in all_prefixes:
            if name_upper.startswith(prefix):
                dcons.append(name)
                break
    
    log.append("Design combinations found = " + str(len(dcons)))
    
    for prefix in design_prefixes:
        count = sum(1 for name in dcons if name.upper().startswith(prefix))
        log.append("  " + prefix + ": " + str(count))
    
    # ============================================================
    # 4. LOAD-CASE LABEL FUNCTION
    # ============================================================
    
    def get_load_label(case_name):
        c = case_name.upper().replace(" ", "").replace("_", "")
        
        mapping = {
            "DEAD": "D",
            "SDL": "SDL",
            "LIVE": "L",
            "WX": "Wx",
            "WY": "Wy",
            "EQX": "Ex",
            "EQY": "Ey",
            "ROOF": "R",
            "SNOW": "S",
            "RAIN": "R",
            "WIND": "W",
            "SEISMIC": "E"
        }
        
        if c in mapping:
            return mapping[c]
        
        if "WX" in c or "WINDX" in c:
            return "Wx"
        if "WY" in c or "WINDY" in c:
            return "Wy"
        if "EQX" in c or "SEISMICX" in c:
            return "Ex"
        if "EQY" in c or "SEISMICY" in c:
            return "Ey"
        
        return case_name[:4]
    
    # ============================================================
    # 5. PROCESS EACH DESIGN COMBO
    # ============================================================
    
    if len(dcons) > 0:
        log.append("\nStarting to process " + str(len(dcons)) + " design combinations...")
        
        for combo in dcons:
            log.append("")
            log.append("PROCESSING: " + combo)
            
            types_array = System.Array.CreateInstance(System.Int32, 0)
            cases_array = System.Array.CreateInstance(System.String, 0)
            factors_array = System.Array.CreateInstance(System.Double, 0)
            
            ret_val, case_count, types, cases, factors = SapModel.RespCombo.GetCaseList(
                combo, 0, types_array, cases_array, factors_array
            )
            
            if ret_val != 0:
                errors.append(combo + " | GetCaseList error = " + str(ret_val))
                continue
            
            log.append(combo + " contains " + str(case_count) + " items")
            
            for i in range(case_count):
                log.append("  " + str(i+1) + ". " + cases[i] + " = " + str(factors[i]))
            
            # ============================================================
            # BUILD DESIRED NAME
            # ============================================================
            
            new_name_parts = []
            
            for i in range(case_count):
                factor = float(factors[i])
                case_label = get_load_label(cases[i])
                
                if abs(factor - round(factor)) < 0.001:
                    term = "%d%s" % (abs(round(factor)), case_label)
                else:
                    term = "%.2f%s" % (abs(factor), case_label)
                
                if i == 0:
                    if factor < 0:
                        new_name_parts.append("-" + term)
                    else:
                        new_name_parts.append(term)
                else:
                    if factor < 0:
                        new_name_parts.append("-" + term)
                    else:
                        new_name_parts.append("+" + term)
            
            new_name = "".join(new_name_parts)
            log.append("Desired name = " + new_name)
            
            # ============================================================
            # CHECK IF TARGET NAME ALREADY EXISTS
            # ============================================================
            
            if new_name in all_names:
                log.append("Target already exists -> deleting " + new_name)
                ret = SapModel.RespCombo.Delete(new_name)
                if ret != 0:
                    errors.append(combo + " | Cannot delete existing target " + new_name + " | Delete error = " + str(ret))
                    continue
                all_names.remove(new_name)
            
            # ============================================================
            # CREATE NEW RESPONSE COMBINATION
            # ============================================================
            
            add_ret = SapModel.RespCombo.Add(new_name, 0)
            log.append("Add(" + new_name + ") = " + str(add_ret))
            
            if add_ret != 0:
                errors.append(combo + " -> " + new_name + " | ADD FAILED | return = " + str(add_ret))
                continue
            
            # ============================================================
            # COPY EVERY CASE TO NEW COMBINATION
            # ============================================================
            
            copy_ok = True
            
            for i in range(case_count):
                case_name = cases[i]
                factor = float(factors[i])
                case_type = ETABSv17.eCNameType.LoadCase
                
                try:
                    set_ret = SapModel.RespCombo.SetCaseList(
                        new_name,
                        case_type,
                        case_name,
                        factor
                    )
                    
                    log.append("  SetCaseList: " + case_name + " = " + str(factor) + " | return = " + str(set_ret))
                    
                    if set_ret != 0:
                        copy_ok = False
                        errors.append(combo + " -> " + new_name + " | SetCaseList FAILED: " + case_name + " | return = " + str(set_ret))
                        
                except Exception as ex:
                    copy_ok = False
                    errors.append(combo + " -> " + new_name + " | EXCEPTION in SetCaseList for " + case_name + " | " + str(ex))
            
            # ============================================================
            # VERIFY NEW COMBINATION
            # ============================================================
            
            if copy_ok:
                verify_types = System.Array.CreateInstance(System.Int32, 0)
                verify_cases = System.Array.CreateInstance(System.String, 0)
                verify_factors = System.Array.CreateInstance(System.Double, 0)
                
                ret_val, verify_count, v_types, v_cases, v_factors = SapModel.RespCombo.GetCaseList(
                    new_name, 0, verify_types, verify_cases, verify_factors
                )
                
                if ret_val != 0:
                    errors.append(combo + " -> " + new_name + " | VERIFICATION GetCaseList FAILED = " + str(ret_val))
                    continue
                
                log.append("Verification items = " + str(verify_count))
                
                exact_match = True
                
                if verify_count != case_count:
                    exact_match = False
                    errors.append(combo + " -> " + new_name + " | Expected " + str(case_count) + " cases but got " + str(verify_count))
                else:
                    for i in range(case_count):
                        original_case = cases[i]
                        original_factor = float(factors[i])
                        
                        copied_case = v_cases[i]
                        copied_factor = float(v_factors[i])
                        
                        if original_case != copied_case:
                            exact_match = False
                            errors.append(combo + " -> " + new_name + " | CASE MISMATCH: " + original_case + " != " + copied_case)
                        
                        if abs(original_factor - copied_factor) > 0.000001:
                            exact_match = False
                            errors.append(combo + " -> " + new_name + " | FACTOR MISMATCH: " + str(original_factor) + " != " + str(copied_factor))
                
                # ============================================================
                # DELETE ORIGINAL ONLY IF EVERYTHING IS CORRECT
                # ============================================================
                
                if exact_match:
                    del_ret = SapModel.RespCombo.Delete(combo)
                    
                    if del_ret == 0:
                        created.append(new_name)
                        log.append("SUCCESS: " + combo + " -> " + new_name + " (original deleted)")
                        if combo in all_names:
                            all_names.remove(combo)
                        all_names.append(new_name)
                    else:
                        errors.append(combo + " -> " + new_name + " | DELETE FAILED | return = " + str(del_ret))
                else:
                    errors.append(combo + " -> " + new_name + " | NOT DELETED BECAUSE VERIFICATION FAILED")
            else:
                errors.append(combo + " -> " + new_name + " | NOT DELETED BECAUSE COPY FAILED")
    else:
        log.append("No design combinations found to process")

# ============================================================
# REFRESH ETABS VIEW
# ============================================================

try:
    SapModel.View.RefreshView(0, False)
except:
    pass
    
# ============================================================
# 6. FINAL CLEANUP
# ============================================================

log.append("")
log.append("========== FINAL DESIGN COMBO CLEANUP ==========")

design_prefixes = [
    "DCON",
    "U",
    "DWAL",
    "DSLBU",
    "DSTLS",
    "DSTLD",
    "DCMP",
    "UDCON",
    "UDWAL",
    "UDSLBU",
    "UDSTL"
]

keep_names = set(created)

log.append(
    "Renamed combinations to KEEP = " +
    str(len(keep_names))
)

names_array = System.Array.CreateInstance(
    System.String,
    0
)

ret_val, name_count, names = SapModel.RespCombo.GetNameList(
    0,
    names_array
)

if ret_val != 0:
    errors.append(
        "FINAL CLEANUP | GetNameList failed = " +
        str(ret_val)
    )
else:
    current_names = []
    for i in range(name_count):
        current_names.append(names[i])

    design_combos_to_delete = []

    for name in current_names:
        name_upper = name.upper()
        is_design_combo = False

        for prefix in design_prefixes:
            if name_upper.startswith(prefix):
                is_design_combo = True
                break

        if is_design_combo:
            if name not in keep_names:
                design_combos_to_delete.append(name)

    log.append(
        "Other design combinations to DELETE = " +
        str(len(design_combos_to_delete))
    )

    for name in design_combos_to_delete:
        del_ret = SapModel.RespCombo.Delete(name)

        if del_ret == 0:
            log.append(
                "DELETED DESIGN COMBO: " +
                name
            )
        else:
            errors.append(
                "FINAL CLEANUP | Could not delete " +
                name +
                " | Delete error = " +
                str(del_ret)
            )

    names_array2 = System.Array.CreateInstance(
        System.String,
        0
    )

    ret_val2, count2, names2 = SapModel.RespCombo.GetNameList(
        0,
        names_array2
    )

    if ret_val2 == 0:
        remaining_design = []

        for i in range(count2):
            name = names2[i]
            name_upper = name.upper()
            is_design_combo = False

            for prefix in design_prefixes:
                if name_upper.startswith(prefix):
                    is_design_combo = True
                    break

            if is_design_combo:
                remaining_design.append(name)

        log.append(
            "Remaining design combinations = " +
            str(len(remaining_design))
        )

        if len(remaining_design) > 0:
            log.append(
                "WARNING: The following design combos remain:"
            )
            for name in remaining_design:
                log.append("  " + name)
        else:
            log.append(
                "CLEANUP SUCCESS: No other design combinations remain."
            )

# ============================================================
# FINAL OUTPUTS
# ============================================================

Renamed_Combinations = created
Error_Messages = errors
Concrete_Gen_Return = gen_ret_concrete
Total_Renamed = len(created)
Total_Design_Combos = len(dcons)
Log_Messages = log
# ---------- end create_load_combinations_etab_2017_api ----------

# ----
# Load Combinations (Based on Above Load Patterns)
# Note: Although the load cases and load combinations can be generated wtih default design combos. First generate the Load Patterns and then the load combinations in ETAB with default design combos but i dont prefer it.
# Let me show you why?
# I generated the load patterns, right, as per my choice but, now i want automation, which is difficult for me to rename every combination. How will i recognize which combo represent which combinaton?
# So, i should rename them. But manually? :(
# I have to rename all of the combinations. It is time wasting. Lets automate it with ETABs API (I developed a Python Tool for it)
# The API is working fine. The nomenclature has a little bit of problem. I will solve it and reconsider generating and overviewing it in th next video!
# The problem was due to rewriting of the combos...
# Anyhow upon restarting ETAB and Rhino, it is resolved.
# Let me show you how you can generate automated load cases and load combinations.
# I hope it is clear now :)
in_case_of_duplicate_restart_etab_and_gr = Panel(create_load_combinations_etab_2017_api.Total_Design_Combos)  # "In Case of Duplicate Restart ETAB and Grasshopper"

data_2 = Data(reverse(entwine_2))
cull_i = CullIndex(List=data_2, Indices=-1, Wrap=True)
height_in_etab_finalized = Panel(cull_i)

# ----
# Read Concrete and Steel Database
# MS Excel File: Concrete and Steel are Sheets names in "Concrete.xlsx" and "Steel.xlsx".
# These two files acts as a database template for this project and any R.C.C Projects
sheets = Panel("""Concrete
Steel""")
item = ListItem(List=sheets, Index=0, Wrap=True)  # -> Item, Item1
excelread = ExcelReader(ReadExcelData=read_data_from_concrete_and_steel_databa, WorkbookPath=concrete_database, WorksheetName=item.Item)  # -> Exceptions, simplify(ExcelData)
excelread_2 = ExcelReader(ReadExcelData=read_data_from_concrete_and_steel_databa, WorkbookPath=steel_database, WorksheetName=item.Item1)  # -> Exceptions, simplify(ExcelData)
cull_i_2 = CullIndex(List=excelread_2.ExcelData, Indices=0, Wrap=True)
cull_i_3 = CullIndex(List=excelread.ExcelData, Indices=0, Wrap=True)
bang = ExplodeTree(Data=cull_i_3)  # -> Branch0, Branch1, Branch2, Branch3, Branch4, Branch5, Branch6, Branch7
bang_2 = ExplodeTree(Data=cull_i_2)  # -> Branch0, Branch1, Branch2, Branch3, Branch4, Branch5, Branch6, Branch7
entwine_4 = Entwine(
    Branch00=bang.Branch0,
    Branch01=bang.Branch1,
    Branch02=bang.Branch2,
    Branch03=bang.Branch3,
    Branch04=bang.Branch4,
    Branch05=bang.Branch5,
    Branch06=bang.Branch6,
    Branch07=bang.Branch7,
    FlattenInputs=True)
entwine_5 = Entwine(
    Branch00=bang_2.Branch0,
    Branch01=bang_2.Branch1,
    Branch02=bang_2.Branch2,
    Branch03=bang_2.Branch3,
    Branch04=bang_2.Branch4,
    Branch05=bang_2.Branch5,
    Branch06=bang_2.Branch6,
    Branch07=bang_2.Branch7,
    FlattenInputs=True)

# ----
# Story Order in ETAB
listdexs = ListIndices(List=panel_3)
cull_i_4 = CullIndex(List=listdexs, Indices=[0, -1], Wrap=True)
concat = Concatenate(FragmentA="Story", FragmentB=cull_i_4)
entwine_6 = Entwine(Branch00="Base", Branch01=concat, Branch02="Mumty", FlattenInputs=True)  # -> flatten(Result)
data_3 = Data(reverse(entwine_6))
panel_5 = Panel(data_3)

# ----
# Grid System in ETAB
# X-Grid Data
division = Division(A=building_lx_ft, B=bays_along_x_direction)
x_plus_one_2 = XPlusOne(NumberX=bays_along_x_direction)
series_3 = Series(Start=0, Step=division, Count=x_plus_one_2)
x_ordinates = Panel(series_3)

# ----
# Y-Grid Data
division_2 = Division(A=building_ly_ft, B=bays_along_y_direction)
# Note: We need to add Grids. It is important for AutoMeshing in ETAB
x_plus_one_3 = XPlusOne(NumberX=bays_along_y_direction)
series_4 = Series(Start=0, Step=division_2, Count=x_plus_one_3)
y_ordinates = Panel(series_4)

# ----
# Concrete Material - For Beams
list = ItemSelector(
    bang.Branch0,
    {"Concrete_15MPa", "Concrete_16MPa", "Concrete_17MPa", "Concrete_18MPa", "Concrete_19MPa", "Concrete_20MPa", "Concrete_21MPa", "Concrete_22MPa", "Concrete_23MPa", "Concrete_24MPa"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}, selected="Concrete_21MPa")
mindex = MemberIndex(Set=flatten(cull_i_3), Member=list)  # -> Index, Count
item_2 = ListItem(List=entwine_4, Index=mindex.Index, Wrap=True)
bang_3 = ExplodeTree(Data=item_2)  # -> Branch0, Branch1, Branch2, Branch3, Branch4, Branch5, Branch6, Branch7
concrete = Concrete(
    Name=bang_3.Branch0,
    Density=bang_3.Branch1,
    DampingRatio=bang_3.Branch2,
    PoissonsRatio=bang_3.Branch3,
    ThermalExpansionCoeff=bang_3.Branch4,
    YoungsModulus=bang_3.Branch5,
    CylinderStrength=bang_3.Branch6,
    CubeStrength=bang_3.Branch7,
    Component="BH.oM.Structure.MaterialFragments.Concrete")

# ----
# Concrete Material - For Columns
list_2 = ItemSelector(
    bang.Branch0,
    {"Concrete_15MPa", "Concrete_16MPa", "Concrete_17MPa", "Concrete_18MPa", "Concrete_19MPa", "Concrete_20MPa", "Concrete_21MPa", "Concrete_22MPa", "Concrete_23MPa", "Concrete_24MPa"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}, selected="Concrete_28MPa")
mindex_2 = MemberIndex(Set=flatten(cull_i_3), Member=list_2)  # -> Index, Count
item_3 = ListItem(List=entwine_4, Index=mindex_2.Index, Wrap=True)
bang_4 = ExplodeTree(Data=item_3)  # -> Branch0, Branch1, Branch2, Branch3, Branch4, Branch5, Branch6, Branch7
concrete_2 = Concrete(
    Name=bang_4.Branch0,
    Density=bang_4.Branch1,
    DampingRatio=bang_4.Branch2,
    PoissonsRatio=bang_4.Branch3,
    ThermalExpansionCoeff=bang_4.Branch4,
    YoungsModulus=bang_4.Branch5,
    CylinderStrength=bang_4.Branch6,
    CubeStrength=bang_4.Branch7,
    Component="BH.oM.Structure.MaterialFragments.Concrete")

# ----
# Concrete Material - For Slabs/Floors
list_3 = ItemSelector(
    bang.Branch0,
    {"Concrete_15MPa", "Concrete_16MPa", "Concrete_17MPa", "Concrete_18MPa", "Concrete_19MPa", "Concrete_20MPa", "Concrete_21MPa", "Concrete_22MPa", "Concrete_23MPa", "Concrete_24MPa"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}, selected="Concrete_21MPa")
mindex_3 = MemberIndex(Set=flatten(cull_i_3), Member=list_3)  # -> Index, Count
item_4 = ListItem(List=entwine_4, Index=mindex_3.Index, Wrap=True)
bang_5 = ExplodeTree(Data=item_4)  # -> Branch0, Branch1, Branch2, Branch3, Branch4, Branch5, Branch6, Branch7
concrete_3 = Concrete(
    Name=bang_5.Branch0,
    Density=bang_5.Branch1,
    DampingRatio=bang_5.Branch2,
    PoissonsRatio=bang_5.Branch3,
    ThermalExpansionCoeff=bang_5.Branch4,
    YoungsModulus=bang_5.Branch5,
    CylinderStrength=bang_5.Branch6,
    CubeStrength=bang_5.Branch7,
    Component="BH.oM.Structure.MaterialFragments.Concrete")

# ----
# Rebar Material - For Columns
list_4 = ItemSelector(
    bang_2.Branch0,
    {"A36", "A53GrB", "A500GrB_Rect", "A500GrB_Cir", "A572Gr50", "A913Gr50", "A992Fy50", "Grade40", "Grade60", "A615Gr75", "A706Gr60", "A416Gr250", "A416Gr270"}, selected="Grade60")
mindex_4 = MemberIndex(Set=flatten(cull_i_2), Member=list_4)  # -> Index, Count
item_5 = ListItem(List=entwine_5, Index=mindex_4.Index, Wrap=True)
bang_6 = ExplodeTree(Data=item_5)  # -> Branch0, Branch1, Branch2, Branch3, Branch4, Branch5, Branch6, Branch7
steel = Steel(
    Name=bang_6.Branch0,
    YoungsModulus=bang_6.Branch1,
    PoissonsRatio=bang_6.Branch2,
    ThermalExpansionCoeff=bang_6.Branch3,
    Density=bang_6.Branch4,
    DampingRatio=bang_6.Branch5,
    YieldStress=bang_6.Branch6,
    UltimateStress=bang_6.Branch7,
    Component="{ .Steel")

# ----
# Rebar Material - For Beams
list_5 = ItemSelector(
    bang_2.Branch0,
    {"A36", "A53GrB", "A500GrB_Rect", "A500GrB_Cir", "A572Gr50", "A913Gr50", "A992Fy50", "Grade40", "Grade60", "A615Gr75", "A706Gr60", "A416Gr250", "A416Gr270"}, selected="Grade40")
mindex_5 = MemberIndex(Set=flatten(cull_i_2), Member=list_5)  # -> Index, Count
item_6 = ListItem(List=entwine_5, Index=mindex_5.Index, Wrap=True)
bang_7 = ExplodeTree(Data=item_6)  # -> Branch0, Branch1, Branch2, Branch3, Branch4, Branch5, Branch6, Branch7
steel_2 = Steel(
    Name=bang_7.Branch0,
    YoungsModulus=bang_7.Branch1,
    PoissonsRatio=bang_7.Branch2,
    ThermalExpansionCoeff=bang_7.Branch3,
    Density=bang_7.Branch4,
    DampingRatio=bang_7.Branch5,
    YieldStress=bang_7.Branch6,
    UltimateStress=bang_7.Branch7,
    Component="{ .Steel")

# ----
# Conversion to Meters
expression = Expression(x=building_lx_ft, Expression="x*0.3048")
expression_2 = Expression(x=building_ly_ft, Expression="x*0.3048")

# ----
# In Organized
xy = XYPlane(Origin=Point(0, 0, 0))
expression_3 = Expression(x=story_height_ft, Expression="x*0.3048")
rectangle = Rectangle(Plane=xy, XSize=expression, YSize=expression_2, Radius=0)  # -> Rectangle, Length
debrep = DeconstructBrep(Brep=rectangle.Rectangle)  # -> Faces, Edges, Vertices
Z = UnitZ(Factor=expression_3)
item_7 = ListItem(List=debrep.Edges, Index=0, Wrap=True)  # -> Item, Item1, Item2, Item3
boundary = BoundarySurfaces(Edges=rectangle.Rectangle)
divide = DivideCurve(Curve=[item_7.Item, item_7.Item2], Count=bays_along_x_direction, Kinks=False)  # -> Points, Tangents, Parameters
divide_2 = DivideCurve(Curve=[item_7.Item1, item_7.Item3], Count=bays_along_y_direction, Kinks=False)  # -> Points, Tangents, Parameters
split = SplitList(List=flatten(divide.Points), Index=expr("X+1", bays_along_x_direction))  # -> ListA, ListB
split_2 = SplitList(List=flatten(divide_2.Points), Index=expr("X+1", bays_along_y_direction))  # -> ListA, ListB
ln = Line(StartPoint=reverse(split.ListA), EndPoint=split.ListB)
ln_2 = Line(StartPoint=reverse(split_2.ListA), EndPoint=split_2.ListB)
srfsplit = SurfaceSplit(Surface=boundary, Curves=flatten([ln, ln_2]))
lng = ListLength(List=srfsplit)
multiplication = Multiplication(A=lng, B=choose_location_of_stairs)
expression_4 = Expression(x=mumty_height_ft, Expression="x*0.3048")
int = Integer(multiplication)
ccx = CurveCurve(CurveA=graft(ln), CurveB=flatten(ln_2))  # -> Points, ParamsA, ParamsB
arrlinear = LinearArray(Geometry=[ln, ln_2], Direction=Z, Count=expr("x+1", number_of_stories))  # -> Geometry, Transform
item_8 = ListItem(List=flatten(srfsplit), Index=int, Wrap=True)
multiplication_2 = Multiplication(A=number_of_stories, B=expression_3)
addition_2 = Addition(A=multiplication_2, B=expression_4)
cull_i_5 = CullIndex(List=arrlinear.Geometry, Indices=0, Wrap=True)
area = Area(Geometry=item_8)  # -> Area, Centroid
Z_2 = UnitZ(Factor=addition_2)
Z_3 = UnitZ(Factor=multiplication_2)
move = Move(Geometry=item_8, Motion=Z_2)  # -> Geometry, Transform
area_2 = Area(Geometry=srfsplit)  # -> Area, Centroid
line = LineSDL(Start=ccx.Points, Direction=Z_3, Length=multiplication_2)
divide_3 = DivideCurve(Curve=line, Count=number_of_stories, Kinks=False)  # -> Points, Tangents, Parameters
cp = ControlPoints(Curve=move.Geometry)  # -> Points, Weights, Knots
dist = Distance(PointA=area_2.Centroid, PointB=area.Centroid)
duppt = RemoveDuplicatePts(Points=cp.Points, Tolerance=0.01)
equals = Equality(FirstNumber=dist, SecondNumber=0)  # -> Equality, Inequality
end = EndPoints(Curve=cull_i_5)  # -> Start, End
end_2 = EndPoints(Curve=cull_i_5)  # -> Start, End
Z_4 = UnitZ(Factor=expr("-x", expression_4))
cull = CullPattern(List=srfsplit, CullPattern=equals.Inequality)
vec2pt = Vector2Pt(PointA=end_2.Start, PointB=end_2.End, Unitize=False)  # -> flatten(Vector), Length
vec2pt_2 = Vector2Pt(PointA=end.Start, PointB=end.End, Unitize=False)  # -> flatten(Vector), Length
arrlinear_2 = LinearArray(Geometry=cull, Direction=Z, Count=expr("x+1", number_of_stories))  # -> Geometry, Transform
line_2 = LineSDL(Start=duppt, Direction=Z_4, Length=Z_4)
X = UnitX(Factor=1)
X_2 = UnitX(Factor=1)
angle = Angle(VectorA=vec2pt.Vector, VectorB=X)  # -> Angle, Reflex
angle_2 = Angle(VectorA=vec2pt_2.Vector, VectorB=X_2)  # -> Angle, Reflex
cos = Cosine(Value=angle.Angle)
sin = Sine(Value=angle_2.Angle)
abs = Absolute(Value=cos)
cull_2 = CullPattern(List=flatten(cull_i_5), CullPattern=sin)
cull_3 = CullPattern(List=flatten(cull_i_5), CullPattern=abs)

# ----
# Infilled Wall At Boundary
arrlinear_3 = LinearArray(Geometry=rectangle.Rectangle, Direction=Z, Count=expr("x+1", number_of_stories))  # -> Geometry, Transform
cull_i_6 = CullIndex(List=arrlinear_3.Geometry, Indices=[-1, 0], Wrap=True)
extr = Extrude(Base=cull_i_6, Direction=Z)
preview = CustomPreview(Geometry=extr, Material=ColourSwatch(SwatchColor=RGBA(161, 102, 255, 55)))

# ----
# Frame Members Connectivity
of_infilled_wall = Slider(0.5, range=0.2..0.7)

# ----
# Paraphet Wall
item_9 = ListItem(List=arrlinear_3.Geometry, Index=expr("-1", 0), Wrap=True)
multiplication_3 = Multiplication(A=Z, B=of_infilled_wall)
extr_2 = Extrude(Base=item_9, Direction=multiplication_3)
preview_2 = CustomPreview(Geometry=extr_2, Material=ColourSwatch(SwatchColor=RGBA(36, 255, 105, 55)))

# ----
# Height of Paraphet Wall (m)
bounds = Bounds(Numbers=multiplication_3)
deconstruct_domain = DeconstructDomain(Domain=bounds)  # -> Start, End
panel_6 = Panel(deconstruct_domain.Start)

# ----
# Bar Sizes and Cross Sectional Areas (Pakistani Sizes)
us_customary_bar_no_approx = Panel("""#2 (approx.)
#3 (approx.)
#3
#4
#5
#6
#7
#8
#9
#10
#11
#12 (approx.)""")
cross_sectiona_area_m² = Panel("""0.000028
0.000050
0.000079
0.000113
0.000201
0.000314
0.000380
0.000491
0.000616
0.000804
0.001018
0.001257""")
nominal_diameter_m = Panel("""0.006
0.008
0.010
0.012
0.016
0.020
0.022
0.025
0.028
0.032
0.036
0.040""")

duppt_2 = RemoveDuplicatePts(Points=flatten([divide.Points, divide_2.Points]), Tolerance=0.01)
number_slider = Slider(1, range=1..10)
crv_cp = CurveClosestPoint(Point=duppt_2, Curve=rectangle.Rectangle)  # -> Point, Parameter, Distance
shatter = Shatter(Curve=rectangle.Rectangle, Parameters=crv_cp.Parameter)
midpt = CurveMiddle(Curve=shatter)
points = PointList(Points=flatten(ccx.Points), Size=number_slider)
points_2 = PointList(Points=midpt, Size=number_slider)
panel_7 = Panel("""17
18
21
22
18
22""")

# ----
# Concrete Material - For Slabs/Floors
list_6 = ItemSelector(
    bang.Branch0,
    {"Concrete_15MPa", "Concrete_16MPa", "Concrete_17MPa", "Concrete_18MPa", "Concrete_19MPa", "Concrete_20MPa", "Concrete_21MPa", "Concrete_22MPa", "Concrete_23MPa", "Concrete_24MPa"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}, selected="Concrete_25MPa")
mindex_6 = MemberIndex(Set=flatten(cull_i_3), Member=list_6)  # -> Index, Count
item_10 = ListItem(List=entwine_4, Index=mindex_6.Index, Wrap=True)
bang_8 = ExplodeTree(Data=item_10)  # -> Branch0, Branch1, Branch2, Branch3, Branch4, Branch5, Branch6, Branch7
concrete_4 = Concrete(
    Name=bang_8.Branch0,
    Density=bang_8.Branch1,
    DampingRatio=bang_8.Branch2,
    PoissonsRatio=bang_8.Branch3,
    ThermalExpansionCoeff=bang_8.Branch4,
    YoungsModulus=bang_8.Branch5,
    CylinderStrength=bang_8.Branch6,
    CubeStrength=bang_8.Branch7,
    Component="BH.oM.Structure.MaterialFragments.Concrete")

corner_1 = Panel("""0
23""")
corner_2 = Panel("""8
9""")
corner_4 = Panel("""20
21""")
corner_3 = Panel("""11
12""")
bang_9 = ExplodeTree(Data=graft(panel_7))  # -> Branch0, Branch1, Branch2, Branch3, Branch4, Branch5
item_11 = ListItem(List=shatter, Index="4", Wrap=True)
item_12 = ListItem(List=shatter, Index="16", Wrap=True)
item_13 = ListItem(List=shatter, Index=corner_1, Wrap=True)
item_14 = ListItem(List=shatter, Index=corner_2, Wrap=True)
item_15 = ListItem(List=shatter, Index=corner_3, Wrap=True)
item_16 = ListItem(List=shatter, Index=corner_4, Wrap=True)
thickness_of_wall_m = Slider(0.15, range=0..1)
density_of_material_kg_m3 = Slider(1880, range=0..10000)

# ----
# Only If Core Walls are On Sides of Stairs
debrep_2 = DeconstructBrep(Brep=move.Geometry)  # -> Faces, Edges, Vertices
Z_5 = UnitZ(Factor=expr("-X", expression_4))
item_17 = ListItem(List=debrep_2.Edges, Index=[0, 1, 3], Wrap=True)
extr_3 = Extrude(Base=item_17, Direction=Z_5)

item_18 = ListItem(List=flatten(ccx.Points), Index=bang_9.Branch4, Wrap=True)
item_19 = ListItem(List=flatten(ccx.Points), Index=bang_9.Branch5, Wrap=True)

item_20 = ListItem(List=flatten(ccx.Points), Index=bang_9.Branch0, Wrap=True)
item_21 = ListItem(List=flatten(ccx.Points), Index=bang_9.Branch1, Wrap=True)
item_22 = ListItem(List=flatten(ccx.Points), Index=bang_9.Branch2, Wrap=True)
item_23 = ListItem(List=flatten(ccx.Points), Index=bang_9.Branch3, Wrap=True)

expression_5 = Expression(x=thickness_of_wall_m, y=deconstruct_domain.Start, z=density_of_material_kg_m3, Expression="x*y*z*9.81")
unit_consistency = Panel("""m*m*(kg/m^3)*(m/s^2)
kg/(s^2)
(kg.m/s^2)/m
N/m""")

# ----
# Template - UDL for External Walls/Paraphet Walls
# x - Thickness of Wall (m)
# y - Height of Wall (m)
# z - Density (kg/m3)
expression_6 = Expression(x=thickness_of_wall_m, y=expression_3, z=density_of_material_kg_m3, Expression="x*y*z*9.81")
panel_8 = Panel([expression_6, expression_5])

ln_3 = Line(StartPoint=item_18, EndPoint=item_19)
ln_4 = Line(StartPoint=item_20, EndPoint=item_21)
ln_5 = Line(StartPoint=item_22, EndPoint=item_23)
expression_7 = Expression(x=story_height_ft, Expression="x*0.3048")
Z_6 = UnitZ(Factor=expression_7)
extr_4 = Extrude(Base=[ln_4, ln_5, item_13, item_14, item_15, item_16, item_11, item_12, ln_3], Direction=Z_6)
mesh_uv = MeshSurface(Surface=extr_4, UCount=5, VCount=5, Overhang=True, Equalize=False)
paneltype = PanelType(
    {"Undefined": 0, "Slab": 1, "Wall": 2, "PileCap": 3, "DropPanel": 4}, selected="Wall",
    Component="BH.oM.Structure.SurfaceProperties.PanelType",
    Selection=2)
nv = NakedVertices(Mesh=mesh_uv)  # -> ClothedIndex, NakedIndex, ClothedPts, flatten(NakedPts)
arrlinear_4 = LinearArray(Geometry=extr_4, Direction=Z, Count=number_of_stories)  # -> Geometry, Transform
constantthickness = ConstantThickness(
    Name="SW",
    Thickness=Slider(0.2, range=0..1),
    Material=concrete_4,
    PanelType=paneltype,
    Component="BH.oM.Structure.SurfaceProperties.ConstantThickness")
filter = StreamFilter(Gate=apply_all_modifiers, Stream0=1, Stream1="0.6")
filter_2 = StreamFilter(Gate=apply_all_modifiers, Stream0=1, Stream1="0.25")
pdecon = Deconstruct(Point=nv.NakedPts)  # -> XComponent, YComponent, ZComponent
smaller = SmallerThan(FirstNumber=pdecon.ZComponent, SecondNumber=0)  # -> SmallerThan, OrEqualTo
name_must_be_sw_for_etab_api = Panel("SW")
applymodifiers = ApplyModifiers(
    Walls=constantthickness,
    Fxx=filter,
    Fxy=filter,
    Fyy=filter,
    Mxx=filter_2,
    Mxy=filter_2,
    Myy=filter_2,
    Vxz=1,
    Vyz=1,
    Mass=1,
    Weight=1,
    Component="{ .ApplyModifiers")
cull_4 = CullPattern(List=nv.NakedPts, CullPattern=smaller.OrEqualTo)

# ----
# All Columns
shatter_2 = Shatter(Curve=line, Parameters=divide_3.Parameters)

# ----
# All Slabs
cull_i_7 = CullIndex(List=arrlinear_2.Geometry, Indices=0, Wrap=True)

panel_9 = Panel(
    Surface=flatten([arrlinear_4.Geometry, extr_3]),
    Property=applymodifiers,
    Name=name_must_be_sw_for_etab_api,
    Tolerance=1e-06,
    Component="{ .Panel")

# ----
# Geometric Inputs
# for BHoM
beams_x_direction = Curve(flatten(cull_3))
beams_y_direction = Curve(flatten(cull_2))
all_columns = Curve(flatten([shatter_2, line_2]))
all_slabs = Surface(flatten([cull_i_7, move.Geometry]))
base_of_all_columns = Point(flatten(ccx.Points))
base_of_all_walls = Point(flatten(cull_4))

# ----
# Beams in X Direction - Exclusing Top Story
multiplication_4 = Multiplication(A=story_height_ft, B=number_of_stories)
end_3 = EndPoints(Curve=beams_x_direction)  # -> Start, End
expression_8 = Expression(x=multiplication_4, Expression="x*0.3048")
pdecon_2 = Deconstruct(Point=end_3.Start)  # -> XComponent, YComponent, ZComponent
pdecon_3 = Deconstruct(Point=end_3.End)  # -> XComponent, YComponent, ZComponent
smaller_2 = SmallerThan(FirstNumber=pdecon_2.ZComponent, SecondNumber=expression_8)  # -> SmallerThan, OrEqualTo
smaller_3 = SmallerThan(FirstNumber=pdecon_3.ZComponent, SecondNumber=expression_8)  # -> SmallerThan, OrEqualTo
cull_5 = CullPattern(List=end_3.Start, CullPattern=smaller_2.SmallerThan)
cull_6 = CullPattern(List=end_3.End, CullPattern=smaller_3.SmallerThan)

# ----
# Beams in Y Direction - Exclusing Top Story
multiplication_5 = Multiplication(A=story_height_ft, B=number_of_stories)
end_4 = EndPoints(Curve=beams_y_direction)  # -> Start, End
expression_9 = Expression(x=multiplication_5, Expression="x*0.3048")
pdecon_4 = Deconstruct(Point=end_4.Start)  # -> XComponent, YComponent, ZComponent
pdecon_5 = Deconstruct(Point=end_4.End)  # -> XComponent, YComponent, ZComponent
smaller_4 = SmallerThan(FirstNumber=pdecon_4.ZComponent, SecondNumber=expression_9)  # -> SmallerThan, OrEqualTo
smaller_5 = SmallerThan(FirstNumber=pdecon_5.ZComponent, SecondNumber=expression_9)  # -> SmallerThan, OrEqualTo
cull_7 = CullPattern(List=end_4.Start, CullPattern=smaller_4.SmallerThan)
cull_8 = CullPattern(List=end_4.End, CullPattern=smaller_5.SmallerThan)
ln_6 = Line(StartPoint=cull_7, EndPoint=cull_8)

# ----
# For Only Paraphet Wall UDL
larger = LargerThan(FirstNumber=pdecon_2.ZComponent, SecondNumber=expression_8)  # -> LargerThan, OrEqualTo
larger_2 = LargerThan(FirstNumber=pdecon_3.ZComponent, SecondNumber=expression_8)  # -> LargerThan, OrEqualTo
larger_3 = LargerThan(FirstNumber=pdecon_4.ZComponent, SecondNumber=expression_9)  # -> LargerThan, OrEqualTo
larger_4 = LargerThan(FirstNumber=pdecon_5.ZComponent, SecondNumber=expression_9)  # -> LargerThan, OrEqualTo
cull_9 = CullPattern(List=end_3.Start, CullPattern=larger.OrEqualTo)
cull_10 = CullPattern(List=end_3.End, CullPattern=larger_2.OrEqualTo)
cull_11 = CullPattern(List=end_4.Start, CullPattern=larger_3.OrEqualTo)
cull_12 = CullPattern(List=end_4.End, CullPattern=larger_4.OrEqualTo)
ln_7 = Line(StartPoint=cull_9, EndPoint=cull_10)
ln_8 = Line(StartPoint=cull_11, EndPoint=cull_12)
item_24 = ListItem(List=reverse(ln_7), Index=0, Wrap=True)
item_25 = ListItem(List=reverse(ln_8), Index=0, Wrap=True)
edges = BrepEdges(Brep=move.Geometry)  # -> Naked, Interior, NonManifold
item_26 = ListItem(List=ln_7, Index=0, Wrap=True)
item_27 = ListItem(List=ln_8, Index=0, Wrap=True)
divide_4 = DivideCurve(Curve=item_26, Count=bays_along_x_direction, Kinks=False)  # -> Points, Tangents, Parameters
divide_5 = DivideCurve(Curve=item_27, Count=bays_along_y_direction, Kinks=False)  # -> Points, Tangents, Parameters
divide_6 = DivideCurve(Curve=item_24, Count=bays_along_x_direction, Kinks=False)  # -> Points, Tangents, Parameters
divide_7 = DivideCurve(Curve=item_25, Count=bays_along_y_direction, Kinks=False)  # -> Points, Tangents, Parameters
shatter_3 = Shatter(Curve=item_26, Parameters=flatten(divide_4.Parameters))
shatter_4 = Shatter(Curve=item_24, Parameters=flatten(divide_6.Parameters))
shatter_5 = Shatter(Curve=item_27, Parameters=flatten(divide_5.Parameters))
shatter_6 = Shatter(Curve=item_25, Parameters=flatten(divide_7.Parameters))
merge = Merge(Data1=edges.Naked, Data2=shatter_3, Data3=shatter_4, Data4=shatter_5, Data5=shatter_6)

duppt_3 = RemoveDuplicatePts(Points=flatten([base_of_all_columns, base_of_all_walls]), Tolerance=0.01)

# ----
# Template - Boundary Conditions - Base Supports
# Modifications in Base with Structural Elements: Incase Shear Wall, Stair Cores & Stairs are Present, must be included in BHoM Nodes
# For Special Ductile Shear Walls, the procedure needs a little modifications in Nodes
doftype = DOFType(
    {"Free": 0, "Fixed": 1, "FixedNegative": 2, "FixedPositive": 3, "Spring": 4, "SpringNegative": 5, "SpringPositive": 6, "SpringRelative": 7, "SpringRelativeNegative": 8, "SpringRelativePositive": 9, "NonLinear": 10, "Friction": 11, "Damped": 12, "Gap": 13}, selected="Fixed",
    Component="BH.oM.Structure.Constraints.DOFType",
    Selection=1)
constraint6dof = Constraint6DOF(
    Name="Base Nodes",
    TranslationalStiffnessX=0,
    TranslationalStiffnessY=0,
    TranslationalStiffnessZ=0,
    RotationalStiffnessX=0,
    RotationalStiffnessY=0,
    RotationalStiffnessZ=0,
    TranslationX=doftype,
    TranslationY=doftype,
    TranslationZ=doftype,
    RotationX=doftype,
    RotationY=doftype,
    RotationZ=doftype,
    Component="BH.oM.Structure.Constraints.Constraint6DOF")
pdecon_6 = Deconstruct(Point=duppt_3)  # -> XComponent, YComponent, ZComponent
point = Point(X=pdecon_6.XComponent, Y=pdecon_6.YComponent, Z=pdecon_6.ZComponent, Component="{ .Point")
node = Node(Position=point, Support=constraint6dof, Name="Base", Component="BH.oM.Structure.Elements.Node")

# ----
# Template - Pull Load Cases from ETAB
createtype = CreateType(Component="BH.oM.Structure.Loads.Loadcase")
pulltype = PullType({"AdapterDefault": 0}, selected="AdapterDefault", Component="BH.oM.Adapter.PullType", Selection=0)
filterbybhomtype = FilterByBHoMType(BHoMType=createtype, Component="{ .FilterByBHoMType")
pull = Pull(Adapter=etabs17adapter, Request=filterbybhomtype, PullType=pulltype, Active=get_all_load_cases, Component="{ .Pull")
load_cases_generated_with_etab_api = Panel(pull)
explode = Explode(Object=pull, Component="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")  # -> Name, Nature, Number, BHoM_Guid, Fragments, Tags, CustomData
panel_10 = Panel(explode.Name)

# ----
# Top Story Internal Beams
larger_5 = LargerThan(FirstNumber=pdecon_2.ZComponent, SecondNumber=expression_8)  # -> LargerThan, OrEqualTo
larger_6 = LargerThan(FirstNumber=pdecon_3.ZComponent, SecondNumber=expression_8)  # -> LargerThan, OrEqualTo
larger_7 = LargerThan(FirstNumber=pdecon_4.ZComponent, SecondNumber=expression_9)  # -> LargerThan, OrEqualTo
larger_8 = LargerThan(FirstNumber=pdecon_5.ZComponent, SecondNumber=expression_9)  # -> LargerThan, OrEqualTo
cull_13 = CullPattern(List=end_3.Start, CullPattern=larger_5.OrEqualTo)
cull_14 = CullPattern(List=end_3.End, CullPattern=larger_6.OrEqualTo)
cull_15 = CullPattern(List=end_4.Start, CullPattern=larger_7.OrEqualTo)
cull_16 = CullPattern(List=end_4.End, CullPattern=larger_8.OrEqualTo)
ln_9 = Line(StartPoint=cull_13, EndPoint=cull_14)
ln_10 = Line(StartPoint=cull_15, EndPoint=cull_16)
divide_8 = DivideCurve(Curve=ln_9, Count=bays_along_x_direction, Kinks=False)  # -> Points, Tangents, Parameters
divide_9 = DivideCurve(Curve=ln_10, Count=bays_along_y_direction, Kinks=False)  # -> Points, Tangents, Parameters
shatter_7 = Shatter(Curve=ln_9, Parameters=flatten(divide_8.Parameters))
shatter_8 = Shatter(Curve=ln_10, Parameters=flatten(divide_9.Parameters))

# ----
# For Full Wall UDL
ln_11 = Line(StartPoint=cull_5, EndPoint=cull_6)

# ----
# Split and Arrange Beams
divide_10 = DivideCurve(Curve=ln_11, Count=bays_along_x_direction, Kinks=False)  # -> Points, Tangents, Parameters
divide_11 = DivideCurve(Curve=ln_6, Count=bays_along_y_direction, Kinks=False)  # -> Points, Tangents, Parameters
shatter_9 = Shatter(Curve=ln_11, Parameters=flatten(divide_10.Parameters))
shatter_10 = Shatter(Curve=ln_6, Parameters=flatten(divide_11.Parameters))

# ----
# Live Load
list_7 = ItemSelector(explode.Nature, {"Dead"}, selected="Dead")

# ----
# SDL Load
list_8 = ItemSelector(explode.Nature, {"Dead"}, selected="Dead")

expression_10 = Expression(x=Slider(5, range=0..10), Expression="x*0.3048")
item_28 = ListItem(List=flatten(ccx.Points), Index="8", Wrap=True)
item_29 = ListItem(List=flatten(ccx.Points), Index="12", Wrap=True)
X_3 = UnitX(Factor=expression_10)
Y = UnitY(Factor=expression_10)
move_2 = Move(Geometry=item_29, Motion=expr("-x", X_3))  # -> Geometry, Transform
move_3 = Move(Geometry=item_28, Motion=X_3)  # -> Geometry, Transform
move_4 = Move(Geometry=move_3.Geometry, Motion=expr("-x", Y))  # -> Geometry, Transform
move_5 = Move(Geometry=move_2.Geometry, Motion=expr("-x", Y))  # -> Geometry, Transform

expression_11 = Expression(x=Slider(5, range=0..10), Expression="x*0.3048")
item_30 = ListItem(List=flatten(ccx.Points), Index="11", Wrap=True)
item_31 = ListItem(List=flatten(ccx.Points), Index="15", Wrap=True)
X_4 = UnitX(Factor=expression_11)
Y_2 = UnitY(Factor=expression_11)
move_6 = Move(Geometry=item_31, Motion=expr("-x", X_4))  # -> Geometry, Transform
move_7 = Move(Geometry=item_30, Motion=X_4)  # -> Geometry, Transform
move_8 = Move(Geometry=move_7.Geometry, Motion=Y_2)  # -> Geometry, Transform
move_9 = Move(Geometry=move_6.Geometry, Motion=Y_2)  # -> Geometry, Transform

expression_12 = Expression(x=Slider(5, range=0..10), Expression="x*0.3048")
item_32 = ListItem(List=flatten(ccx.Points), Index="24", Wrap=True)
item_33 = ListItem(List=flatten(ccx.Points), Index="28", Wrap=True)
X_5 = UnitX(Factor=expression_12)
Y_3 = UnitY(Factor=expression_12)
move_10 = Move(Geometry=item_33, Motion=expr("-x", X_5))  # -> Geometry, Transform
move_11 = Move(Geometry=item_32, Motion=X_5)  # -> Geometry, Transform
move_12 = Move(Geometry=move_11.Geometry, Motion=expr("-x", Y_3))  # -> Geometry, Transform
move_13 = Move(Geometry=move_10.Geometry, Motion=expr("-x", Y_3))  # -> Geometry, Transform

# ----
# Shear Caps (SAFE)
number_slider_2 = Slider(5, range=0..10)
expression_13 = Expression(x=number_slider_2, Expression="x*0.3048")
item_34 = ListItem(List=flatten(ccx.Points), Index="27", Wrap=True)
item_35 = ListItem(List=flatten(ccx.Points), Index="31", Wrap=True)
X_6 = UnitX(Factor=expression_13)
Y_4 = UnitY(Factor=expression_13)
move_14 = Move(Geometry=item_35, Motion=expr("-x", X_6))  # -> Geometry, Transform
move_15 = Move(Geometry=item_34, Motion=X_6)  # -> Geometry, Transform
move_16 = Move(Geometry=move_15.Geometry, Motion=Y_4)  # -> Geometry, Transform
move_17 = Move(Geometry=move_14.Geometry, Motion=Y_4)  # -> Geometry, Transform

panel_11 = Panel(move_10.Geometry)
panel_12 = Panel(move_13.Geometry)
panel_13 = Panel(move_11.Geometry)
panel_14 = Panel(move_12.Geometry)

panel_15 = Panel(move_14.Geometry)
panel_16 = Panel(move_17.Geometry)
panel_17 = Panel(move_15.Geometry)
panel_18 = Panel(move_16.Geometry)

panel_19 = Panel(move_2.Geometry)
panel_20 = Panel(move_5.Geometry)
panel_21 = Panel(move_3.Geometry)
panel_22 = Panel(move_4.Geometry)

panel_23 = Panel(move_6.Geometry)
panel_24 = Panel(move_9.Geometry)
panel_25 = Panel(move_7.Geometry)
panel_26 = Panel(move_8.Geometry)

pushtype = PushType(
    {"FullPush": 0, "CreateOnly": 1, "CreateNonExisting": 2, "UpdateOnly": 3, "UpdateOrCreateOnly": 4, "DeleteThenCreate": 5, "AdapterDefault": 6}, selected="CreateNonExisting",
    Component="BH.oM.Adapter.PushType",
    Selection=2)

# ----
# Template - Frame Members (Beams and Columns without Section Modifiers)
column_min_cover_m = Slider(0.025, range=0..0.1)
column_h_mm = Slider(457.261017, range=300..500)
column_w_mm = Slider(457.261017, range=300..500)
beam_min_cover_m = Slider(0.025, range=0..0.1)
beam_h_mm = Slider(457.2610169, range=300..500)
beam_w_mm = Slider(381.0508475, range=300..400)

# ----
# Reinforcement in Columns
spacing_for_bar_size_8 = Panel("0.0254")
steel_area = Slider(1, range=1..6)
list_9 = ItemSelector(
    us_customary_bar_no_approx,
    {"#2 (approx.)", "#3 (approx.)", "#3", "#4", "#5", "#6", "#7", "#8", "#9", "#10", "#11", "#12 (approx.)"}, selected="#4")
mindex_7 = MemberIndex(Set=us_customary_bar_no_approx, Member=list_9)  # -> Index, Count
expression_14 = Expression(x=beam_h_mm, y=beam_w_mm, z=steel_area, Expression="(x*y*(z/100))/1000000")
item_36 = ListItem(List=nominal_diameter_m, Index=mindex_7.Index, Wrap=True)

# ----
# Reinforcement in Columns
spacing_for_bar_size_8_2 = Panel("0.0254")
steel_area_2 = Slider(1, range=1..6)
list_10 = ItemSelector(
    us_customary_bar_no_approx,
    {"#2 (approx.)", "#3 (approx.)", "#3", "#4", "#5", "#6", "#7", "#8", "#9", "#10", "#11", "#12 (approx.)"}, selected="#4")
mindex_8 = MemberIndex(Set=us_customary_bar_no_approx, Member=list_10)  # -> Index, Count
expression_15 = Expression(x=column_h_mm, y=column_w_mm, z=steel_area_2, Expression="(x*y*(z/100))/1000000")
item_37 = ListItem(List=nominal_diameter_m, Index=mindex_8.Index, Wrap=True)

# ----
# Template API - Beam
set_design_preferences_for_concrete_beam = GhPythonScript(Prop="BeamSec15x18in", Run=set_design_preferences_for_beams)  # -> Status; "Set Design Preferences for Concrete Beams (ETAB API)"; inputs Prop: list
# ---------- set_design_preferences_for_concrete_beam: Python ----------
"""
FINAL VERSION - SetRebarBeam
Inputs:
    Prop : List of frame section names
    Run  : Boolean

Output:
    Status : Conversion status
"""

import clr
clr.AddReference("ETABSv17")
import ETABSv17
import System

helper = ETABSv17.Helper()
etabs = helper.GetObject("CSI.ETABS.API.ETABSObject")
SapModel = etabs.SapModel

print("Connected to ETABS")

# Output status
Status = []

# Only run when Run is True
if Run:

    # Convert each section name provided through Prop
    for target in Prop:

        print("\nConverting: " + target)
        print("Using SetRebarBeam with 9 arguments...")

        try:
            # SetRebarBeam with exactly 9 arguments
            ret = SapModel.PropFrame.SetRebarBeam(
                target,        # 1. Name
                "A615Gr60",    # 2. Longitudinal material
                "A615Gr60",    # 3. Confinement material
                1,             # 4. Pattern (1 = typical)
                0.0,           # 5. Start rebar ratio
                0.0,           # 6. End rebar ratio
                "#9",          # 7. Top bar size
                "#9",          # 8. Bottom bar size
                "#4"           # 9. Stirrup size
            )

            if ret == 0:
                message = target + " → Converted successfully"
                print("✓ SUCCESS: " + message)
                Status.append(message)
            else:
                message = target + " → Failed (Error code: " + str(ret) + ")"
                print("✗ " + message)
                Status.append(message)

        except Exception as e:
            message = target + " → Error: " + str(e)
            print("✗ " + message)
            Status.append(message)

            # Try with different argument order
            print("\nTrying alternative parameter order...")

            try:
                ret = SapModel.PropFrame.SetRebarBeam(
                    target,        # 1. Name
                    "A615Gr60",    # 2. Longitudinal material
                    "A615Gr60",    # 3. Confinement material
                    0.06,          # 4. Top rebar ratio
                    0.06,          # 5. Bottom rebar ratio
                    0,             # 6. Top cover
                    0,             # 7. Bottom cover
                    0,             # 8. Stirrup size
                    0              # 9. Number of stirrup legs
                )

                if ret == 0:
                    message = target + " Converted successfully"
                    print("SUCCESS: " + message)

                    # Replace previous error with success
                    Status[-1] = message

                else:
                    message = target + "Failed with error: " + str(ret)
                    print("" + message)

            except Exception as e2:
                message = target + "Alternative also failed: " + str(e2)
                print("" + message)

else:
    Status = ["Run = False"]

print("\n--- STATUS ---")
for s in Status:
    print(s)
# ---------- end set_design_preferences_for_concrete_beam ----------

bottomreinforcement = BottomReinforcement(
    Diameter=item_37,
    Area=expression_15,
    Spacing=spacing_for_bar_size_8_2,
    StartLocation=0,
    EndLocation=1,
    Material=steel,
    Component="{ .BottomReinforcement")
bottomreinforcement_2 = BottomReinforcement(
    Diameter=item_36,
    Area=expression_14,
    Spacing=spacing_for_bar_size_8,
    StartLocation=0,
    EndLocation=1,
    Material=steel_2,
    Component="{ .BottomReinforcement")
barrebarintent = BarRebarIntent(
    BarReinforcement=bottomreinforcement,
    MinimumCover=column_min_cover_m,
    Component="BH.oM.Structure.Reinforcement.BarRebarIntent")
barrebarintent_2 = BarRebarIntent(
    BarReinforcement=bottomreinforcement_2,
    MinimumCover=beam_min_cover_m,
    Component="BH.oM.Structure.Reinforcement.BarRebarIntent")
concreterectanglesection = ConcreteRectangleSection(
    Height=expr("x/1000", column_h_mm),
    Width=expr("x/1000", column_w_mm),
    Material=concrete_2,
    Name="ColSec18x18in",
    RebarIntent=barrebarintent,
    Component="{ .ConcreteRectangleSection")
concreterectanglesection_2 = ConcreteRectangleSection(
    Height=expr("x/1000", beam_h_mm),
    Width=expr("x/1000", beam_w_mm),
    Material=concrete,
    Name="BeamSec15x18in",
    RebarIntent=barrebarintent_2,
    Component="{ .ConcreteRectangleSection")

# ----
# Column Section Modifiers
panel_27 = Panel("1")
# Template  - Section Modifiers (ACI 318-05)
panel_28 = Panel("0.7")
sectionmodifier = SectionModifier(Area=panel_28, Iy=panel_28, Iz=panel_28, J=panel_27, Asy=1, Asz=1, Component="BH.oM.Structure.Fragments.SectionModifier")
addfragment = AddFragment(IBHoMObject=concreterectanglesection, Fragment=sectionmodifier, Replace=apply_all_modifiers, Component="{ .AddFragment")

# ----
# Beam Section Modifiers
panel_29 = Panel("1")
sectionmodifier_2 = SectionModifier(Area=1, Iy="0.35", Iz="0.35", J=panel_29, Asy=1, Asz=1, Component="BH.oM.Structure.Fragments.SectionModifier")
addfragment_2 = AddFragment(
    IBHoMObject=concreterectanglesection_2,
    Fragment=sectionmodifier_2,
    Replace=apply_all_modifiers,
    Component="{ .AddFragment")

# ----
# All Columns
barfeatype = BarFEAType(
    {"Flexural": 0, "Axial": 1, "CompressionOnly": 2, "TensionOnly": 3}, selected="Flexural",
    Component="BH.oM.Structure.Elements.BarFEAType",
    Selection=0)
bar = Bar(Line=all_columns, SectionProperty=addfragment, OrientationAngle=0, FeaType=barfeatype, Component="{ .Bar")

# ----
# Template - UDL of Exterior Wall and Paraphet Wall
# Note that the Paraphet Wall and Mumty Wall has same height considered in this case
barfeatype_2 = BarFEAType(
    {"Flexural": 0, "Axial": 1, "CompressionOnly": 2, "TensionOnly": 3}, selected="Flexural",
    Component="BH.oM.Structure.Elements.BarFEAType",
    Selection=0)
list_11 = ItemSelector(explode.Nature, {"Dead"}, selected="Dead")
bar_2 = Bar(Line=flatten(shatter_9), SectionProperty=addfragment_2, OrientationAngle=0, FeaType=barfeatype_2, Component="{ .Bar")
bar_3 = Bar(Line=flatten(shatter_10), SectionProperty=addfragment_2, OrientationAngle=0, FeaType=barfeatype_2, Component="{ .Bar")
bar_4 = Bar(Line=flatten(merge), SectionProperty=addfragment_2, OrientationAngle=0, FeaType=barfeatype_2, Component="{ .Bar")
txt = Text(explode.Nature)
txt_2 = Text(list_11)
txt_3 = Text(list_11)
txt_4 = Text(explode.Nature)
merge_2 = Merge(Data1=bar_2, Data2=bar_3)
mindex_9 = MemberIndex(Set=txt, Member=txt_2)  # -> Index, Count
merge_3 = Merge(Data1=bar_4)
mindex_10 = MemberIndex(Set=txt_4, Member=txt_3)  # -> Index, Count
item_38 = ListItem(List=pull, Index=mindex_9.Index, Wrap=True)
bhomgroup = BHoMGroup(Elements=merge_2, DownCast=True, Component="{ .BHoMGroup")
vector = Vector(Z=expr("-x", expression_6), Component="{ .Vector")
item_39 = ListItem(List=pull, Index=mindex_10.Index, Wrap=True)
bhomgroup_2 = BHoMGroup(Elements=merge_3, DownCast=True, Component="{ .BHoMGroup")
vector_2 = Vector(Z=expr("-x", expression_5), Component="{ .Vector")
baruniformlydistributedload = BarUniformlyDistributedLoad(
    Force=vector,
    Moment="{ \"_t\" : \"BH.oM.Geometry.Vector\", \"X\" : 0.0, \"Y\" : 0.0, \"Z\" : 0.0, \"_bhomVersion\" : \"9.2\" }",
    Loadcase=item_38,
    Objects=bhomgroup,
    Axis="{ \"_t\" : \"System.Enum\", \"TypeName\" : { \"_t\" : \"System.Type\", \"Name\" : \"BH.oM.Structure.Loads.LoadAxis\", \"_bhomVersion\" : \"9.2\" }, \"Value\" : \"Global\", \"_bhomVersion\" : \"9.2\" }",
    Projected=False,
    Component="BH.oM.Structure.Loads.BarUniformlyDistributedLoad")
baruniformlydistributedload_2 = BarUniformlyDistributedLoad(
    Force=vector_2,
    Moment="{ \"_t\" : \"BH.oM.Geometry.Vector\", \"X\" : 0.0, \"Y\" : 0.0, \"Z\" : 0.0, \"_bhomVersion\" : \"9.2\" }",
    Loadcase=item_39,
    Objects=bhomgroup_2,
    Axis="{ \"_t\" : \"System.Enum\", \"TypeName\" : { \"_t\" : \"System.Type\", \"Name\" : \"BH.oM.Structure.Loads.LoadAxis\", \"_bhomVersion\" : \"9.2\" }, \"Value\" : \"Global\", \"_bhomVersion\" : \"9.2\" }",
    Projected=False,
    Component="BH.oM.Structure.Loads.BarUniformlyDistributedLoad")
bar_5 = Bar(Line=flatten(shatter_7), SectionProperty=addfragment_2, OrientationAngle=0, FeaType=barfeatype_2, Component="{ .Bar")
bar_6 = Bar(Line=flatten(shatter_8), SectionProperty=addfragment_2, OrientationAngle=0, FeaType=barfeatype_2, Component="{ .Bar")
merge_4 = Merge(Data1=bar_5, Data2=bar_6)

# ----
# All Slabs Modifiers
panel_30 = Panel("0.25")
filter_3 = StreamFilter(Gate=apply_all_modifiers, Stream0=1, Stream1=panel_30)

# ----
# All Slabs/Floors Properties
# Note: No water tank separate load is taken however it depends on how much height is the water tank have. Anyways skip it this time.
thickness_of_all_slabs_mm = Slider(0.152, range=0..1)
shelltype = ShellType(
    {"ShellThin": 0, "ShellThick": 1, "Membrane": 2}, selected="ShellThin",
    Component="BH.oM.Adapters.ETABS.ShellType",
    Selection=0)
constantthickness_2 = ConstantThickness(
    Name="Slabs",
    Thickness=thickness_of_all_slabs_mm,
    Material=concrete_3,
    PanelType=shelltype,
    Component="BH.oM.Structure.SurfaceProperties.ConstantThickness")

applymodifiers_2 = ApplyModifiers(
    Slabs=constantthickness_2,
    Fxx=1,
    Fxy=1,
    Fyy=1,
    Mxx=filter_3,
    Mxy=filter_3,
    Myy=filter_3,
    Vxz=1,
    Vyz=1,
    Mass=1,
    Weight=1,
    Component="{ .ApplyModifiers")

panel_31 = Panel(Surface=all_slabs, Property=applymodifiers_2, Name="Slabs", Tolerance=1e-06, Component="{ .Panel")

# ----
# Template - Pressure Loads on Shell Elements
# Note: I have avoided the Roof Live Load, Snow Load, Temperature Loads and Accidental Loads. You should work according to your region and requirements
habit_room_floor_pa = Slider(1915, range=0..10000)
habit_room_floor_pa_2 = Slider(2350, range=0..10000)
txt_5 = Text(explode.Nature)
txt_6 = Text(list_7)
txt_7 = Text(explode.Nature)
txt_8 = Text(list_8)
mindex_11 = MemberIndex(Set=txt_5, Member=txt_6)  # -> Index, Count
mindex_12 = MemberIndex(Set=txt_7, Member=txt_8)  # -> Index, Count
vector_3 = Vector(Z=expr("-x", habit_room_floor_pa), Component="{ .Vector")
vector_4 = Vector(Z=expr("-x", habit_room_floor_pa_2), Component="{ .Vector")
item_40 = ListItem(List=pull, Index=mindex_11.Index, Wrap=True)
item_41 = ListItem(List=pull, Index=mindex_12.Index, Wrap=True)
areauniformlydistributedload = AreaUniformlyDistributedLoad(
    Loadcase=item_40,
    Pressure=vector_3,
    Objects=panel_31,
    Axis="{ \"_t\" : \"System.Enum\", \"TypeName\" : { \"_t\" : \"System.Type\", \"Name\" : \"BH.oM.Structure.Loads.LoadAxis\", \"_bhomVersion\" : \"9.2\" }, \"Value\" : \"Global\", \"_bhomVersion\" : \"9.2\" }",
    Projected=False,
    Component="{ .AreaUniformlyDistributedLoad")
areauniformlydistributedload_2 = AreaUniformlyDistributedLoad(
    Loadcase=item_41,
    Pressure=vector_4,
    Objects=panel_31,
    Axis="{ \"_t\" : \"System.Enum\", \"TypeName\" : { \"_t\" : \"System.Type\", \"Name\" : \"BH.oM.Structure.Loads.LoadAxis\", \"_bhomVersion\" : \"9.2\" }, \"Value\" : \"Global\", \"_bhomVersion\" : \"9.2\" }",
    Projected=False,
    Component="{ .AreaUniformlyDistributedLoad")

# ----
# Template - Objects Order (Flexible for Any Kind of Structure)
materials = Merge(Data1=concrete_4, Data2=concrete, Data3=concrete_2, Data4=concrete_3, Data5=steel, Data6=steel_2)  # -> flatten(Result)
members = Merge(Data1=panel_9, Data2=bar_4, Data3=bar, Data4=bar_2, Data5=bar_3, Data6=panel_31, Data7=merge_4)  # -> flatten(Result)
supports = Merge(Data1=node)  # -> flatten(Result)
loads = Merge(
    Data1=areauniformlydistributedload,
    Data2=baruniformlydistributedload,
    Data3=baruniformlydistributedload_2,
    Data4=areauniformlydistributedload_2)

push = Push(
    Adapter=etabs17adapter,
    Objects=flatten([materials, members, loads, supports]),
    PushType=pushtype,
    Active=send_model_to_etab_2017_quick_mesh,
    Component="{ .Push")  # -> Objects, Success
