# Grasshopper definition Pull Existing Section Definitions from ETAB 2017.gh (Grasshopper 1.0.7)
# plug-ins: Human, BH.UI.Grasshopper

# ----
# As per my understanding, BHoM is not capable of distinguish between concrete and steel sections.
createtype = CreateType(Component="BH.oM.Structure.SectionProperties.SteelSection")

filterbybhomtype = FilterByBHoMType(BHoMType=createtype, Component="{ .FilterByBHoMType")
pulltype = PullType({"AdapterDefault": 0}, selected="AdapterDefault", Component="BH.oM.Adapter.PullType", Selection=0)
etabs17adapter = ETABS17Adapter(Active=Toggle(True), Component="{ ..ctor")
pull = Pull(Adapter=etabs17adapter, Request=filterbybhomtype, PullType=pulltype, Active=Toggle(True), Component="{ .Pull")
bhom_sections_post_processing_is_require = Panel(pull)  # "BHoM Sections (Post Processing is Required For Different Sections)"
list = ItemSelector(
    pull,
    {"BH.oM.Structure.SectionProperties.SteelSection", "BH.oM.Structure.SectionProperties.SteelSection", "BH.oM.Structure.SectionProperties.ConcreteSection", "BH.oM.Structure.SectionProperties.ConcreteSection", "BH.oM.Structure.SectionProperties.ConcreteSection", "BH.oM.Structure.SectionProperties.ConcreteSection", "BH.oM.Structure.SectionProperties.ConcreteSection", "BH.oM.Structure.SectionProperties.ConcreteSection", "BH.oM.Structure.SectionProperties.ConcreteSection"}, selected="BH.oM.Structure.SectionProperties.SteelSection")
explode = Explode(Object=list, Component="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")  # -> Name, Fabrication, PlateRestraint, Material, SectionProfile, Area, Rgy, Rgz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
explode_2 = Explode(Object=explode.SectionProfile, Component="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")  # -> Shape, Height, Width, WebThickness, FlangeThickness, RootRadius, ToeRadius, Edges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
explode_3 = Explode(Object=explode_2.Edges, Component="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")  # -> Start, End, Infinite
ln = Line(StartPoint=explode_3.Start, EndPoint=explode_3.End)
join = JoinCurves(Curves=ln, Preserve=False)
Z = UnitZ(Factor=Slider(53, range=0..100))
boundary = BoundarySurfaces(Edges=join)
extr = Extrude(Base=boundary, Direction=Z)
