# Grasshopper definition Pull Material Library From ETAB 2017.gh (Grasshopper 1.0.7)
# plug-ins: Pufferfish, BH.UI.Grasshopper

createtype = CreateType(Component="BH.oM.Structure.MaterialFragments.Concrete")
filterbybhomtype = FilterByBHoMType(BHoMType=createtype, Component="{ .FilterByBHoMType")
pulltype = PullType({"AdapterDefault": 0}, selected="AdapterDefault", Component="BH.oM.Adapter.PullType", Selection=0)
etabs17adapter = ETABS17Adapter(Active=Toggle(True), Component="{ ..ctor")
pull = Pull(Adapter=etabs17adapter, Request=filterbybhomtype, PullType=pulltype, Active=Toggle(True), Component="{ .Pull")
tmatch = MatchText(Text=pull, Pattern="*Concrete", Case=True)
tmatch_2 = MatchText(Text=pull, Pattern="*Steel", Case=True)
cull = CullPattern(List=pull, CullPattern=tmatch_2)
cull_2 = CullPattern(List=pull, CullPattern=tmatch)
steel = ListItem(List=cull, Index=Slider(3, range=0..3), Wrap=True)
concrete = ListItem(List=cull_2, Index=Slider(1, range=0..1), Wrap=True)
in_etab_2017 = Panel(pull)
concrete_definition = Explode(Object=steel, Component="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")  # -> Name, Density, DampingRatio, PoissonsRatio, ThermalExpansionCoeff, YoungsModulus, YieldStress, UltimateStress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
steel_definition = Explode(Object=concrete, Component="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")  # -> Name, Density, DampingRatio, PoissonsRatio, ThermalExpansionCoeff, YoungsModulus, BHoM_Guid, Fragments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
entwine = Entwine(
    Branch00=concrete_definition.Name,
    Branch01=concrete_definition.Density,
    Branch02=concrete_definition.DampingRatio,
    Branch03=concrete_definition.PoissonsRatio,
    Branch04=concrete_definition.ThermalExpansionCoeff,
    Branch05=concrete_definition.YoungsModulus,
    Branch06=concrete_definition.YieldStress,
    Branch07=concrete_definition.UltimateStress,
    Branch08=concrete_definition.BHoM_Guid,
    Branch09=concrete_definition.Fragments,
    Branch010=concrete_definition.Tags,
    Branch011=concrete_definition.CustomData,
    FlattenInputs=True)  # -> flatten(Result)
entwine_2 = Entwine(
    Branch00=steel_definition.Name,
    Branch01=steel_definition.Density,
    Branch02=steel_definition.DampingRatio,
    Branch03=steel_definition.PoissonsRatio,
    Branch04=steel_definition.ThermalExpansionCoeff,
    Branch05=steel_definition.YoungsModulus,
    Branch06=steel_definition.BHoM_Guid,
    Branch07=steel_definition.Fragments,
    Branch08=steel_definition.Tags,
    Branch09=steel_definition.CustomData,
    Branch010=steel_definition.CylinderStrength,
    Branch011=steel_definition.CubeStrength,
    FlattenInputs=True)  # -> flatten(Result)
panel = Panel(entwine)
listdexs = ListIndices(List=in_etab_2017)
panel_2 = Panel(entwine_2)
in_etab_2017_2 = Panel(listdexs)
