# Grasshopper definition Push Materials to ETAB 2017.gh (Grasshopper 1.0.7)
# plug-ins: Pufferfish, BH.UI.Grasshopper

cylinderstrength_mpa = Slider(30000, range=15000..80000)
panel = Panel("C:\Users\Tufail Mabood\Desktop\ETABS-Grasshopper\Mat_Push.EDB")
createtype = CreateType(Component="BH.oM.Structure.MaterialFragments.Concrete")
filterbybhomtype = FilterByBHoMType(BHoMType=createtype, Component="{ .FilterByBHoMType")
expression = Expression(x=cylinderstrength_mpa, Expression="4700*(10^6)*(x/(10^6))^0.5")
youngmodulus_pa = Slider(1.9e+11, range=1.9e+11..2.1e+11)
density_kg_m3 = Slider(2400, range=2400..2500)
density_kg_m3_2 = Slider(7850, range=7800..7850)
fy_pa = Slider(450000000, range=200000000..5600000000)
pulltype = PullType({"AdapterDefault": 0}, selected="AdapterDefault", Component="BH.oM.Adapter.PullType", Selection=0)
expression_2 = Expression(x=cylinderstrength_mpa, Expression="0.8*x")
etabs17adapter = ETABS17Adapter(FilePath=panel, Active=Toggle(True), Component="{ ..ctor")
concat = Concatenate(FragmentA=cylinderstrength_mpa, FragmentB="_Pa")
concrete = Concrete(
    Name=concat,
    Density=density_kg_m3,
    DampingRatio=Slider(0.05, range=0..0.05),
    PoissonsRatio=Slider(0.18, range=0.18..0.2),
    ThermalExpansionCoeff=Slider(1e-06, range=0..1e-06),
    YoungsModulus=expression,
    CylinderStrength=cylinderstrength_mpa,
    CubeStrength=expression_2,
    Component="BH.oM.Structure.MaterialFragments.Concrete")
multiplication = Multiplication(A=fy_pa, B=Slider(1.15, range=1.15..1.3))
pull = Pull(Adapter=etabs17adapter, Request=filterbybhomtype, PullType=pulltype, Active=Toggle(True), Component="{ .Pull")
concat_2 = Concatenate(FragmentA=fy_pa, FragmentB="_Pa")
explode = Explode(Object=concrete, Component="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")  # -> Name, Density, DampingRatio, PoissonsRatio, ThermalExpansionCoeff, YoungsModulus, BHoM_Guid, Fragments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
steel = Steel(
    Name=concat_2,
    YoungsModulus=youngmodulus_pa,
    PoissonsRatio="0.3",
    ThermalExpansionCoeff=Slider(1.1e-05, range=1.1e-05..1.2e-05),
    Density=density_kg_m3_2,
    DampingRatio=Slider(0.01, range=0..0.01),
    YieldStress=fy_pa,
    UltimateStress=multiplication,
    Component="{ .Steel")
in_etab_2017 = Panel(pull)
entwine = Entwine(
    Branch00=explode.Name,
    Branch01=explode.Density,
    Branch02=explode.DampingRatio,
    Branch03=explode.PoissonsRatio,
    Branch04=explode.ThermalExpansionCoeff,
    Branch05=explode.YoungsModulus,
    Branch06=explode.BHoM_Guid,
    Branch07=explode.Fragments,
    Branch08=explode.Tags,
    Branch09=explode.CustomData,
    Branch010=explode.CylinderStrength,
    Branch011=explode.CubeStrength,
    FlattenInputs=True)  # -> flatten(Result)
explode_2 = Explode(Object=steel, Component="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")  # -> Name, Density, DampingRatio, PoissonsRatio, ThermalExpansionCoeff, YoungsModulus, YieldStress, UltimateStress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
listdexs = ListIndices(List=in_etab_2017)
entwine_2 = Entwine(
    Branch00=explode_2.Name,
    Branch01=explode_2.Density,
    Branch02=explode_2.DampingRatio,
    Branch03=explode_2.PoissonsRatio,
    Branch04=explode_2.ThermalExpansionCoeff,
    Branch05=explode_2.YoungsModulus,
    Branch06=explode_2.YieldStress,
    Branch07=explode_2.UltimateStress,
    Branch08=explode_2.BHoM_Guid,
    Branch09=explode_2.Fragments,
    Branch010=explode_2.Tags,
    Branch011=explode_2.CustomData,
    FlattenInputs=True)  # -> flatten(Result)
in_etab_2017_2 = Panel(listdexs)
all_user_defined_materials = Merge(Data1=concrete, Data2=steel)
panel_2 = Panel(entwine)
panel_3 = Panel(entwine_2)
pushtype = PushType(
    {"FullPush": 0, "CreateOnly": 1, "CreateNonExisting": 2, "UpdateOnly": 3, "UpdateOrCreateOnly": 4, "DeleteThenCreate": 5, "AdapterDefault": 6}, selected="CreateNonExisting",
    Component="BH.oM.Adapter.PushType",
    Selection=2)
push = Push(
    Adapter=etabs17adapter,
    Objects=flatten(all_user_defined_materials),
    PushType=pushtype,
    Active=Toggle(False),
    Component="{ .Push")  # -> Objects, Success
