# Grasshopper definition Push Slab Section and Panels To ETAB 2017.gh (Grasshopper 1.0.7)
# plug-ins: BH.UI.Grasshopper, Kangaroo2 Components

lw_ft = Slider(10, range=0..10)
expression = Expression(x=lw_ft, Expression="x*0.3048")
xy = XYPlane(Origin=Point(0, 0, 0))
concrete = Concrete(
    {"3000psiNW": 0, "3000psiLW": 1, "4000psiNW": 2, "4000psiLW": 3, "5000psiNW": 4, "5000psiLW": 5, "6000psiNW": 6, "6000psiLW": 7, "8000psiNW": 8, "8000psiLW": 9, "10000psiNW": 10, "10000psiLW": 11, "12000psiNW": 12, "12000psiLW": 13}, selected="3000psiNW",
    Component="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",
    Selection=0)
shelltype = ShellType(
    {"ShellThin": 0, "ShellThick": 1, "Membrane": 2}, selected="ShellThin",
    Component="BH.oM.Adapters.ETABS.ShellType",
    Selection=0)
rectangle = Rectangle(Plane=xy, XSize=expression, YSize=expression, Radius=0)  # -> Rectangle, Length
boundary = BoundarySurfaces(Edges=rectangle.Rectangle)
cp = ControlPoints(Curve=boundary)  # -> Points, Weights, Knots
duppt = RemoveDuplicatePts(Points=cp.Points, Tolerance=0.01)
panel = Panel(duppt)
constantthickness = ConstantThickness(
    Name="Slab",
    Thickness=Slider(0.2, range=0..1),
    Material=concrete,
    PanelType=shelltype,
    Component="BH.oM.Structure.SurfaceProperties.ConstantThickness")
panel_2 = Panel(Surface=boundary, Property=constantthickness, Name="Slab", Tolerance=1e-06, Component="{ .Panel")
pushtype = PushType(
    {"FullPush": 0, "CreateOnly": 1, "CreateNonExisting": 2, "UpdateOnly": 3, "UpdateOrCreateOnly": 4, "DeleteThenCreate": 5, "AdapterDefault": 6}, selected="CreateNonExisting",
    Component="BH.oM.Adapter.PushType",
    Selection=2)
etabs17adapter = ETABS17Adapter(Active=Toggle(False), Component="{ ..ctor")
explode = Explode(Object=constantthickness, Component="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")  # -> Name, Thickness, Material, PanelType, BHoM_Guid, Fragments, Tags, CustomData
merge = Merge(Data1=constantthickness, Data2=panel_2)
push = Push(Adapter=etabs17adapter, Objects=flatten(merge), PushType=pushtype, Active=Toggle(False), Component="{ .Push")  # -> Objects, Success
explode_2 = Explode(Object=explode.Material, Component="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")  # -> Name, Density, DampingRatio, PoissonsRatio, ThermalExpansionCoeff, YoungsModulus, CylinderStrength, CubeStrength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
